# Grasshopper definition 2021-06-28 Tree Reactions Extractor and Visualiser_OW.gh (Grasshopper 1.0.7)
# Copyright: Lambeth
# plug-ins: Human, EleFront, BH.UI.Grasshopper, TT Toolbox

# 5. Specify Lift# and relevant load case / combo
panel = Panel(""" (WLZ Up)
 (WLZ Down)
 (WLZ Up)-OPER
 (WLZ Down)-OPER
 (WLZ Up)-TYPH
 (WLZ Down)-TYPH
 Typh ULS-01
 Typh ULS-02
 Typh ULS-03
 Typh ULS-04
 Typh ULS-05
 Typh ULS-06
 Typh ULS-07
 Typh ULS-08
 Typh ULS-09
 Typh ULS-10
 Typh ULS-11
 Typh ULS-12
 Typh ULS-13
 Typh ULS-14
 Typh ULS-15
 Typh ULS-16
 Typh ULS-17
 Typh ULS-18
 Typh ULS-19
 Typh ULS-20
 Typh ULS-21
 Typh ULS-22
 Typh ULS-23
 Typh ULS-24
 Typh ULS-25
 Typh ULS-26
 Typh ULS-27
 Typh ULS-28
 Typh ULS-29
 Typh ULS-30
 Typh ULS-31
 Typh ULS-32
 Typh ULS-33
 Typh ULS-34
 Typh ULS-35
 Typh ULS-36
 Typh ULS-37
 Typh ULS-38
 Typh ULS-39
 Typh ULS-40
 Typh ULS-41
 Typh ULS-42
 Typh ULS-43
 Typh ULS-44
 Typh ULS-45
 Typh ULS-46
 Typh ULS-47
 Typh ULS-48
 Typh ULS-49
 Typh ULS-50
 Typh ULS-51
 Typh ULS-52
 Typh ULS-53
 Typh ULS-54
 Typh ULS-55
 Typh ULS-56
 Typh ULS-57
 Typh ULS-58
 Typh ULS-59
 Typh ULS-60
 Typh ULS-61
 Typh ULS-62
 Typh ULS-63
 Typh ULS-64
 Typh ULS-65
 Typh ULS-66
 Typh ULS-67
 Typh ULS-68
 Typh ULS-69
 Typh ULS-70
 Typh ULS-71
 Typh ULS-72
 Typh ULS-73
 Typh ULS-74
 Typh ULS-75
 Typh ULS-76
 Typh ULS-77
 Typh ULS-78
 Typh ULS-79
 Typh ULS-80
 Typh ULS-81
 Typh ULS-82
 Typh ULS-83
 Typh ULS-84
 Typh ULS-85
 Typh ULS-86
 Typh ULS-87
 Typh ULS-88
 Typh ULS-89
 Typh ULS-90
 Typh ULS-91
 Typh ULS-92
 Typh ULS-93
 Typh ULS-94
 Typh ULS-95
 Typh ULS-96
 Oper ULS-01
 Oper ULS-02
 Oper ULS-03
 Oper ULS-04
 Oper ULS-05
 Oper ULS-06
 Oper ULS-07
 Oper ULS-08
 Oper ULS-09
 Oper ULS-10
 Oper ULS-11
 Oper ULS-12
 Oper ULS-13
 Oper ULS-14
 Oper ULS-15
 Oper ULS-16
 Oper ULS-17
 Oper ULS-18
 Oper ULS-19
 Oper ULS-20
 Oper ULS-21
 Oper ULS-22
 Oper ULS-23
 Oper ULS-24
 Oper ULS-25
 Oper ULS-26
 Oper ULS-27
 Oper ULS-28
 Oper ULS-29
 Oper ULS-30
 Oper ULS-31
 Oper ULS-32
 Oper ULS-33
 Oper ULS-34
 Oper ULS-35
 Oper ULS-36
 Oper ULS-37
 Oper ULS-38
 Oper ULS-39
 Oper ULS-40
 Oper ULS-41
 Oper ULS-42
 Oper ULS-43
 Oper ULS-44
 Oper ULS-45
 Oper ULS-46
 Oper ULS-47
 Oper ULS-48
 Oper ULS-49
 Oper ULS-50
 Oper ULS-51
 Oper ULS-52
 Oper ULS-53
 Oper ULS-54
 Oper ULS-55
 Oper ULS-56
 Oper ULS-57
 Oper ULS-58
 Oper ULS-59
 Oper ULS-60
 Oper ULS-61
 Oper ULS-62
 Oper ULS-63
 Oper ULS-64
 Oper ULS-65
 Oper ULS-66
 Oper ULS-67
 Oper ULS-68
 Oper ULS-69
 Oper ULS-70
 Oper ULS-71
 Oper ULS-72
 Oper ULS-73
 Oper ULS-74
 Oper ULS-75
 Oper ULS-76
 Oper ULS-77
 Oper ULS-78
 Oper ULS-79
 Oper ULS-80
 Oper ULS-81
 Oper ULS-82
 Oper ULS-83
 Oper ULS-84
 Oper ULS-85
 Oper ULS-86
 Oper ULS-87
 Oper ULS-88
 Oper ULS-89
 Oper ULS-90
 Oper ULS-91
 Oper ULS-92
 Oper ULS-93
 Oper ULS-94
 Oper ULS-95
 Oper ULS-96""")
lift_case = Panel("""SC Lift#1
SC Lift#2
SC Lift#3
SC Lift#4
SC Lift#5
SC Lift#6
SC Lift#7
SC Lift#8
SC Lift#9
SC Lift#10
SC Lift#11a
SC Lift#11b
SC Lift#12
SC Lift#13a
SC Lift#13b
SC Lift#14
SC Lift#15a
SC Lift#15b
SC Lift#16
SC Lift#17
SC Lift#18a
SC Lift#18b
SC Lift#19
SC Lift#20a
SC Lift#20b
SC Lift#21
SC EndCons""")
graft = GraftTree(Tree=lift_case, IncludeEmptyLists=True, IncludeNullItems=True)
concat = Concatenate(FragmentA=graft, FragmentB=panel)  # -> simplify(Result)
panel_2 = Panel(concat)

# ----
# 10. Button to write all results to CSV
write_csv = Button()
csv = Data(write_csv)

# ----
# 8. Toggle ON to screenshot viewport
toggle = BooleanToggle(True)

# ----
# 2. Toggle ON to connect to SAP model
toggle_2 = BooleanToggle(True)

# ----
# 9. Specify folder locations to write CSV
input_folder_path = Panel("C:\Users\brendanlia\Desktop\Jacking Tower")

# ----
# 1. Right click to select SAP model file path
path = FilePath("C:\Users\brendanlia\Desktop\Jacking Tower\Batch_0\[UNFINISHED, FOR INFO ONLY] T2 EPA_MF3_v17_TO_R7_Batch0.sdb")

# ----
# 3. Specify support node names here
# (need to input more than one element name)
input_node_ids = Panel("""TG_TowerH07_UPD-1
TG_TowerH07_UPD-2
TG_TowerH07_UPD-3
TG_TowerH07_UPD-4
TG_TowerH09_UPD-1
TG_TowerH09_UPD-2
TG_TowerH09_UPD-3
TG_TowerH09_UPD-4
TG_TowerH12_UPD-1
TG_TowerH12_UPD-2
TG_TowerH12_UPD-3
TG_TowerH12_UPD-4
TG_TowerH15-11
TG_TowerH15-12
TG_TowerH15-6
TG_TowerH15-7
TG_TowerH18-11
TG_TowerH18-12
TG_TowerH18-6
TG_TowerH18-7
TG_TowerH21_UPD-1
TG_TowerH21_UPD-2
TG_TowerH21_UPD-3
TG_TowerH21_UPD-4
TG_TowerH24_UPD-1
TG_TowerH24_UPD-2
TG_TowerH24_UPD-3
TG_TowerH24_UPD-4
TG_TowerJ07_UPD-1
TG_TowerJ07_UPD-2
TG_TowerJ07_UPD-3
TG_TowerJ07_UPD-4
TG_TowerJ09_UPD-1
TG_TowerJ09_UPD-2
TG_TowerJ09_UPD-3
TG_TowerJ09_UPD-4
TG_TowerJ10_UPD-1
TG_TowerJ10_UPD-2
TG_TowerJ10_UPD-3
TG_TowerJ10_UPD-4
TG_TowerJ12_UPD-1
TG_TowerJ12_UPD-2
TG_TowerJ12_UPD-3
TG_TowerJ12_UPD-4
TG_TowerJ15-11
TG_TowerJ15-12
TG_TowerJ15-6
TG_TowerJ15-7
TG_TowerJ18-11
TG_TowerJ18-12
TG_TowerJ18-6
TG_TowerJ18-7
TG_TowerJ21_UPD-1
TG_TowerJ21_UPD-2
TG_TowerJ21_UPD-3
TG_TowerJ21_UPD-4
TG_TowerJ24_UPD-1
TG_TowerJ24_UPD-2
TG_TowerJ24_UPD-3
TG_TowerJ24_UPD-4
TG_TowerK07_UPD-1
TG_TowerK07_UPD-2
TG_TowerK07_UPD-3
TG_TowerK07_UPD-4
TG_TowerK10_UPD-1
TG_TowerK10_UPD-2
TG_TowerK10_UPD-3
TG_TowerK10_UPD-4
TG_TowerK12_UPD-1
TG_TowerK12_UPD-2
TG_TowerK12_UPD-3
TG_TowerK12_UPD-4
TG_TowerK15-11
TG_TowerK15-12
TG_TowerK15-6
TG_TowerK15-7
TG_TowerK18-11
TG_TowerK18-12
TG_TowerK18-6
TG_TowerK18-7
TG_TowerK21_UPD-1
TG_TowerK21_UPD-2
TG_TowerK21_UPD-3
TG_TowerK21_UPD-4
TG_TowerK24_UPD-1
TG_TowerK24_UPD-2
TG_TowerK24_UPD-3
TG_TowerK24_UPD-4
TG_TowerL07_UPD-1
TG_TowerL07_UPD-2
TG_TowerL07_UPD-3
TG_TowerL07_UPD-4
TG_TowerL10_UPD-1
TG_TowerL10_UPD-2
TG_TowerL10_UPD-3
TG_TowerL10_UPD-4
TG_TowerL12_UPD-1
TG_TowerL12_UPD-2
TG_TowerL12_UPD-3
TG_TowerL12_UPD-4
TG_TowerL15-11
TG_TowerL15-12
TG_TowerL15-6
TG_TowerL15-7
TG_TowerL18-11
TG_TowerL18-12
TG_TowerL18-6
TG_TowerL18-7
TG_TowerL21_UPD-1
TG_TowerL21_UPD-2
TG_TowerL21_UPD-3
TG_TowerL21_UPD-4
TG_TowerL24_UPD-1
TG_TowerL24_UPD-2
TG_TowerL24_UPD-3
TG_TowerL24_UPD-4
TG_TowerM07_UPD-1
TG_TowerM07_UPD-2
TG_TowerM07_UPD-3
TG_TowerM07_UPD-4
TG_TowerM10_UPD-1
TG_TowerM10_UPD-2
TG_TowerM10_UPD-3
TG_TowerM10_UPD-4
TG_TowerM12_UPD-1
TG_TowerM12_UPD-2
TG_TowerM12_UPD-3
TG_TowerM12_UPD-4
TG_TowerM15-11
TG_TowerM15-12
TG_TowerM15-6
TG_TowerM15-7
TG_TowerM18-11
TG_TowerM18-12
TG_TowerM18-6
TG_TowerM18-7
TG_TowerM21_UPD-1
TG_TowerM21_UPD-2
TG_TowerM21_UPD-3
TG_TowerM21_UPD-4
TG_TowerM24_UPD-1
TG_TowerM24_UPD-2
TG_TowerM24_UPD-3
TG_TowerM24_UPD-4
TG_TowerN07_UPD-1
TG_TowerN07_UPD-2
TG_TowerN07_UPD-3
TG_TowerN07_UPD-4
TG_TowerN10_UPD-1
TG_TowerN10_UPD-2
TG_TowerN10_UPD-3
TG_TowerN10_UPD-4
TG_TowerN12_UPD-1
TG_TowerN12_UPD-2
TG_TowerN12_UPD-3
TG_TowerN12_UPD-4
TG_TowerN15-11
TG_TowerN15-12
TG_TowerN15-6
TG_TowerN15-7
TG_TowerN18-11
TG_TowerN18-12
TG_TowerN18-6
TG_TowerN18-7
TG_TowerN21_UPD-1
TG_TowerN21_UPD-2
TG_TowerN21_UPD-3
TG_TowerN21_UPD-4
TG_TowerN24_UPD-1
TG_TowerN24_UPD-2
TG_TowerN24_UPD-3
TG_TowerN24_UPD-4
TG_TowerP07_UPD-1
TG_TowerP07_UPD-2
TG_TowerP07_UPD-3
TG_TowerP07_UPD-4
TG_TowerP09_UPD-1
TG_TowerP09_UPD-2
TG_TowerP09_UPD-3
TG_TowerP09_UPD-4
TG_TowerP10_UPD-1
TG_TowerP10_UPD-2
TG_TowerP10_UPD-3
TG_TowerP10_UPD-4
TG_TowerP12_UPD-2
TG_TowerP12_UPD-3
TG_TowerP12_UPD-4
TG_TowerP12_UPD-5
TG_TowerP15-11
TG_TowerP15-12
TG_TowerP15-6
TG_TowerP15-7
TG_TowerP18-11
TG_TowerP18-12
TG_TowerP18-6
TG_TowerP18-7
TG_TowerP21_UPD-1
TG_TowerP21_UPD-2
TG_TowerP21_UPD-3
TG_TowerP21_UPD-4
TG_TowerP24_UPD-1
TG_TowerP24_UPD-2
TG_TowerP24_UPD-3
TG_TowerP24_UPD-4
TG_TowerQ07_UPD-1
TG_TowerQ07_UPD-2
TG_TowerQ07_UPD-3
TG_TowerQ07_UPD-4
TG_TowerQ09_UPD-1
TG_TowerQ09_UPD-2
TG_TowerQ09_UPD-3
TG_TowerQ09_UPD-4
TG_TowerQ12_UPD-1
TG_TowerQ12_UPD-2
TG_TowerQ12_UPD-3
TG_TowerQ12_UPD-4
TG_TowerQ15-11
TG_TowerQ15-12
TG_TowerQ15-6
TG_TowerQ15-7
TG_TowerQ18-11
TG_TowerQ18-12
TG_TowerQ18-6
TG_TowerQ18-7
TG_TowerQ21_UPD-1
TG_TowerQ21_UPD-2
TG_TowerQ21_UPD-3
TG_TowerQ21_UPD-4
TG_TowerQ24_UPD-1
TG_TowerQ24_UPD-2
TG_TowerQ24_UPD-3
TG_TowerQ24_UPD-4
TG_TowerTyphBrc-1
TG_TowerTyphBrc-10
TG_TowerTyphBrc-11
TG_TowerTyphBrc-12
TG_TowerTyphBrc-13
TG_TowerTyphBrc-14
TG_TowerTyphBrc-15
TG_TowerTyphBrc-16
TG_TowerTyphBrc-17
TG_TowerTyphBrc-18
TG_TowerTyphBrc-19
TG_TowerTyphBrc-2
TG_TowerTyphBrc-20
TG_TowerTyphBrc-21
TG_TowerTyphBrc-22
TG_TowerTyphBrc-225
TG_TowerTyphBrc-226
TG_TowerTyphBrc-227
TG_TowerTyphBrc-228
TG_TowerTyphBrc-229
TG_TowerTyphBrc-23
TG_TowerTyphBrc-230
TG_TowerTyphBrc-231
TG_TowerTyphBrc-232
TG_TowerTyphBrc-233
TG_TowerTyphBrc-234
TG_TowerTyphBrc-235
TG_TowerTyphBrc-236
TG_TowerTyphBrc-237
TG_TowerTyphBrc-238
TG_TowerTyphBrc-239
TG_TowerTyphBrc-24
TG_TowerTyphBrc-240
TG_TowerTyphBrc-241
TG_TowerTyphBrc-242
TG_TowerTyphBrc-243
TG_TowerTyphBrc-244
TG_TowerTyphBrc-245
TG_TowerTyphBrc-246
TG_TowerTyphBrc-247
TG_TowerTyphBrc-248
TG_TowerTyphBrc-249
TG_TowerTyphBrc-25
TG_TowerTyphBrc-250
TG_TowerTyphBrc-251
TG_TowerTyphBrc-252
TG_TowerTyphBrc-253
TG_TowerTyphBrc-254
TG_TowerTyphBrc-255
TG_TowerTyphBrc-256
TG_TowerTyphBrc-257
TG_TowerTyphBrc-258
TG_TowerTyphBrc-259
TG_TowerTyphBrc-26
TG_TowerTyphBrc-260
TG_TowerTyphBrc-261
TG_TowerTyphBrc-262
TG_TowerTyphBrc-263
TG_TowerTyphBrc-264
TG_TowerTyphBrc-265
TG_TowerTyphBrc-266
TG_TowerTyphBrc-267
TG_TowerTyphBrc-268
TG_TowerTyphBrc-269
TG_TowerTyphBrc-27
TG_TowerTyphBrc-270
TG_TowerTyphBrc-271
TG_TowerTyphBrc-272
TG_TowerTyphBrc-273
TG_TowerTyphBrc-274
TG_TowerTyphBrc-275
TG_TowerTyphBrc-276
TG_TowerTyphBrc-277
TG_TowerTyphBrc-278
TG_TowerTyphBrc-279
TG_TowerTyphBrc-28
TG_TowerTyphBrc-280
TG_TowerTyphBrc-281
TG_TowerTyphBrc-282
TG_TowerTyphBrc-283
TG_TowerTyphBrc-284
TG_TowerTyphBrc-285
TG_TowerTyphBrc-286
TG_TowerTyphBrc-287
TG_TowerTyphBrc-288
TG_TowerTyphBrc-289
TG_TowerTyphBrc-29
TG_TowerTyphBrc-290
TG_TowerTyphBrc-291
TG_TowerTyphBrc-292
TG_TowerTyphBrc-293
TG_TowerTyphBrc-294
TG_TowerTyphBrc-295
TG_TowerTyphBrc-296
TG_TowerTyphBrc-297
TG_TowerTyphBrc-298
TG_TowerTyphBrc-299
TG_TowerTyphBrc-3
TG_TowerTyphBrc-30
TG_TowerTyphBrc-300
TG_TowerTyphBrc-301
TG_TowerTyphBrc-302
TG_TowerTyphBrc-303
TG_TowerTyphBrc-304
TG_TowerTyphBrc-305
TG_TowerTyphBrc-306
TG_TowerTyphBrc-307
TG_TowerTyphBrc-308
TG_TowerTyphBrc-309
TG_TowerTyphBrc-31
TG_TowerTyphBrc-310
TG_TowerTyphBrc-311
TG_TowerTyphBrc-312
TG_TowerTyphBrc-313
TG_TowerTyphBrc-314
TG_TowerTyphBrc-315
TG_TowerTyphBrc-316
TG_TowerTyphBrc-32
TG_TowerTyphBrc-4
TG_TowerTyphBrc-5
TG_TowerTyphBrc-597
TG_TowerTyphBrc-598
TG_TowerTyphBrc-599
TG_TowerTyphBrc-6
TG_TowerTyphBrc-600
TG_TowerTyphBrc-601
TG_TowerTyphBrc-602
TG_TowerTyphBrc-603
TG_TowerTyphBrc-604
TG_TowerTyphBrc-605
TG_TowerTyphBrc-606
TG_TowerTyphBrc-607
TG_TowerTyphBrc-608
TG_TowerTyphBrc-609
TG_TowerTyphBrc-610
TG_TowerTyphBrc-611
TG_TowerTyphBrc-612
TG_TowerTyphBrc-613
TG_TowerTyphBrc-614
TG_TowerTyphBrc-7
TG_TowerTyphBrc-8
TG_TowerTyphBrc-9""")

# ----
# 7. Toggle ON to pull nodes from SAP model
toggle_3 = BooleanToggle(True)

list = ValueList({"SC Lift#1": 0, "SC Lift#2": 1, "SC Lift#3": 2, "SC Lift#4": 3, "SC Lift#5": 4, "SC Lift#6": 5, "SC Lift#7": 6, "SC Lift#8": 7, "SC Lift#9": 8, "SC Lift#10": 9, "SC Lift#11a": 10, "SC Lift#11b": 11, "SC Lift#12": 12, "SC Lift#13a": 13, "SC Lift#13b": 14, "SC Lift#14": 15, "SC Lift#15a": 16, "SC Lift#15b": 17, "SC Lift#16": 18, "SC Lift#17": 19, "SC Lift#18a": 20, "SC Lift#18b": 21, "SC Lift#19": 22, "SC Lift#20a": 23, "SC Lift#20b": 24, "SC Lift#21": 25, "SC EndCons": 26}, selected="SC Lift#1")

# ----
# 6. Toggle ON to pull reactions from SAP model
toggle_4 = BooleanToggle(True)

createtype = CreateType(Component="BH.oM.Structure.Elements.Node")
filterrequest = FilterRequest(Type=createtype, Component="{ .FilterRequest")
item = ListItem(List=lift_case, Index=list, Wrap=False)

# ----
# Show File Name
split = TextSplit(Text=path, Separators="\")
geo = Geometry(<point referenced from the Rhino model>)
item_2 = ListItem(List=split, Index=0, Wrap=True)  # -> Item1, Item
pt = Point(geo)
concat_2 = Concatenate(FragmentA="File name: ", FragmentB=item_2.Item1)
xy = XYPlane(Origin=pt)
text = DefineText(Text=concat_2, Plane=xy, Size=Slider(3.5, range=0.5..5), Font="Arial")
material = CreateMaterial(Diffuse=RGB(0, 0, 0), Specular=RGB(255, 255, 255), Emission=RGB(0, 0, 0), Transparency=0, Shine=0)

concat_3 = Concatenate(FragmentA=input_folder_path, FragmentB="/position.xlsx")
wo = WriteOptions(
    FilePath=concat_3,
    ClearDataOverwrite=True,
    SaveAfterWrite=True,
    CloseAfterWrite=True,
    ColumnStartPosition=1,
    RowStartPosition=1)  # -> UserMessages, WriteOptions
panel_3 = Panel("""Name
X (m)
Y (m)
Z (m)""")

# ----
# SAP2000 Reactions Extractor & Visualiser
# 4. Tabulate all relevant cases and
# combos from SAP model
tsort = SortText(Keys=concat, Culture=127)  # -> simplify(Keys), Values
folder_path = Panel("C:\Users\brendanlia\Desktop\Jacking Tower\")
sap2000adapter = SAP2000Adapter(FilePath=path, Active=toggle_2, Component="{ ..ctor")
cases_combos = Data(tsort.Keys)
lift = Data(list)
node_ids = Data(input_node_ids)
adapter = Data(sap2000adapter)
node_ids_2 = Data(node_ids)
addition = Addition(A=lift, B=1)
lng = ListLength(List=node_ids)
info_sap_model_location = Panel(path)
lng_2 = ListLength(List=cases_combos)
lift_2 = Data(list)
case_combo = Data(Slider(0, range=0..99))
cases_combos_2 = Data(cases_combos)
info_nodes_requested = Panel(lng)
info_result_cases_requested = Panel(lng_2)
case_combo_2 = Data(case_combo)
branch = TreeBranch(Tree=cases_combos_2, Path=lift_2, MaintainPaths=True)
case_combo_3 = Data(branch)
noderesultrequest = NodeResultRequest(
    ResultType="{ \"_t\" : \"System.Enum\", \"TypeName\" : { \"_t\" : \"System.Type\", \"Name\" : \"BH.oM.Structure.Requests.NodeResultType\", \"_bhomVersion\" : \"4.2\" }, \"Value\" : \"NodeReaction\", \"_bhomVersion\" : \"4.2\" }",
    Axis="{ \"_t\" : \"System.Enum\", \"TypeName\" : { \"_t\" : \"System.Type\", \"Name\" : \"BH.oM.Structure.Loads.LoadAxis\", \"_bhomVersion\" : \"4.2\" }, \"Value\" : \"Global\", \"_bhomVersion\" : \"4.2\" }",
    Cases=case_combo_3,
    ObjectIds=node_ids_2,
    Component="BH.oM.Structure.Requests.NodeResultRequest")
pull = Pull(
    Adapter=adapter,
    Request=noderesultrequest,
    PullType="{ \"_t\" : \"System.Enum\", \"TypeName\" : { \"_t\" : \"System.Type\", \"Name\" : \"BH.oM.Adapter.PullType\", \"_bhomVersion\" : \"4.2\" }, \"Value\" : \"AdapterDefault\", \"_bhomVersion\" : \"4.2\" }",
    Active=toggle_4,
    Component="{ .Pull")
item_3 = ListItem(List=branch, Index=case_combo_2, Wrap=False)
pulled_results = Data(pull)
pulled_results_2 = Data(pull)
getproperty = GetProperty(Obj=pulled_results, PropName="ResultCase", Component="{ .GetProperty")
case_combo_4 = Data(item_3)
case_combo_5 = Data(case_combo_4)
load_case = Panel(case_combo_5)
concat_4 = Concatenate(FragmentA=folder_path, FragmentE=addition, FragmentB=" Prints\", FragmentC=load_case, FragmentD=".jpg")
saveview = SaveViewportToFile(Run=toggle, Render=False, FilePath=concat_4, ScaleFactor=Slider(5, range=0..10))
extractraw = ExtractRaw(lift=pulled_results_2)
concat_5 = Concatenate(FragmentA=input_folder_path, FragmentD="\ExtractedRawReactionForces_", FragmentC=item)
csv_2 = Data(csv)
info_load_case_combo = Panel(case_combo_4)
case_combo_6 = Data(case_combo_4)
node_ids_3 = Data(node_ids)
c_script = CSharpScript(Path=concat_5, DataSet=simplify(extractraw), Run=csv_2)  # -> out, A; inputs Path: String, DataSet: tree, Run: Boolean
# ---------- c_script: C# ----------
    if (Run)
    {
      List<List<string>> MyData = new List<List<string>>();

      for (int i = 0; i < DataSet.Branches.Count; i++)
      {
        List<string> tempList = new List<string>();

        foreach (var item in DataSet.Branches[i])
        {
          tempList.Add(item.ToString());
        }
        MyData.Add(tempList);
      }

      if (MyData != null && MyData.Count > 0 && Path != String.Empty)
      {
        using (var writer = new CsvFileWriter(Path + ".csv"))
        {
          // Write each row of data
          foreach (var myList in MyData)
          {
            writer.WriteRow(myList);
          }
        }
      }
    }
# ---------- c_script: C# additional code ----------
  /// <summary>
  /// Determines how empty lines are interpreted when reading CSV files.
  /// These values do not affect empty lines that occur within quoted fields
  /// or empty lines that appear at the end of the input file.
  /// </summary>
  public enum EmptyLineBehavior
  {
    /// <summary>
    /// Empty lines are interpreted as a line with zero columns.
    /// </summary>
    NoColumns,
    /// <summary>
    /// Empty lines are interpreted as a line with a single empty column.
    /// </summary>
    EmptyColumn,
    /// <summary>
    /// Empty lines are skipped over as though they did not exist.
    /// </summary>
    Ignore,
    /// <summary>
    /// An empty line is interpreted as the end of the input file.
    /// </summary>
    EndOfFile,
  }

  /// <summary>
  /// Common base class for CSV reader and writer classes.
  /// </summary>
  public abstract class CsvFileCommon
  {
    /// <summary>
    /// These are special characters in CSV files. If a column contains any
    /// of these characters, the entire column is wrapped in double quotes.
    /// </summary>
    protected char[] SpecialChars = new char[] { ',', '"', '\r', '\n' };

    // Indexes into SpecialChars for characters with specific meaning
    private const int DelimiterIndex = 0;
    private const int QuoteIndex = 1;

    /// <summary>
    /// Gets/sets the character used for column delimiters.
    /// </summary>
    public char Delimiter
    {
      get { return SpecialChars[DelimiterIndex]; }
      set { SpecialChars[DelimiterIndex] = value; }
    }

    /// <summary>
    /// Gets/sets the character used for column quotes.
    /// </summary>
    public char Quote
    {
      get { return SpecialChars[QuoteIndex]; }
      set { SpecialChars[QuoteIndex] = value; }
    }
  }

  /// <summary>
  /// Class for writing to comma-separated-value (CSV) files.
  /// </summary>
  public class CsvFileWriter : CsvFileCommon, IDisposable
  {
    // Private members
    private StreamWriter Writer;
    private string OneQuote = null;
    private string TwoQuotes = null;
    private string QuotedFormat = null;

    /// <summary>
    /// Initializes a new instance of the CsvFileWriter class for the
    /// specified stream.
    /// </summary>
    /// <param name="stream">The stream to write to</param>
    public CsvFileWriter(Stream stream)
    {
      Writer = new StreamWriter(stream);
    }

    /// <summary>
    /// Initializes a new instance of the CsvFileWriter class for the
    /// specified file path.
    /// </summary>
    /// <param name="path">The name of the CSV file to write to</param>
    public CsvFileWriter(string path)
    {
      Writer = new StreamWriter(path);
    }

    /// <summary>
    /// Writes a row of columns to the current CSV file.
    /// </summary>
    /// <param name="columns">The list of columns to write</param>
    public void WriteRow(List<string> columns)
    {
      // Verify required argument
      if (columns == null)
        throw new ArgumentNullException("columns");

      // Ensure we're using current quote character
      if (OneQuote == null || OneQuote[0] != Quote)
      {
        OneQuote = String.Format("{0}", Quote);
        TwoQuotes = String.Format("{0}{0}", Quote);
        QuotedFormat = String.Format("{0}{{0}}{0}", Quote);
      }

      // Write each column
      for (int i = 0; i < columns.Count; i++)
      {
        // Add delimiter if this isn't the first column
        if (i > 0)
          Writer.Write(Delimiter);
        // Write this column
        if (columns[i].IndexOfAny(SpecialChars) == -1)
          Writer.Write(columns[i]);
        else
          Writer.Write(QuotedFormat, columns[i].Replace(OneQuote, TwoQuotes));
      }
      Writer.WriteLine();
    }

    // Propagate Dispose to StreamWriter
    public void Dispose()
    {
      Writer.Dispose();
    }
  }
# ---------- end c_script ----------
mindex = MemberIndex(Set=getproperty, Member=case_combo_6)  # -> Index, Count
item_4 = ListItem(List=pulled_results, Index=mindex.Index, Wrap=True)
pulled_results_3 = Data(item_4)

pull_2 = Pull(
    Adapter=adapter,
    Request=filterrequest,
    PullType="{ \"_t\" : \"System.Enum\", \"TypeName\" : { \"_t\" : \"System.Type\", \"Name\" : \"BH.oM.Adapter.PullType\", \"_bhomVersion\" : \"4.2\" }, \"Value\" : \"AdapterDefault\", \"_bhomVersion\" : \"4.2\" }",
    Active=toggle_3,
    Component="{ .Pull")
getproperty_2 = GetProperty(Obj=pull_2, PropName="Fragments.Id", Component="{ .GetProperty")  # -> flatten(Value)
mindex_2 = MemberIndex(Set=getproperty_2, Member=node_ids_3)  # -> flatten(Index), Count
panel_4 = Panel(pull)
item_5 = ListItem(List=pull_2, Index=mindex_2.Index, Wrap=True)

pulled_nodes = Data(item_5)
custom = Custom(pulled_results=pulled_results_3, pulled_nodes=pulled_nodes)
custom_2 = Data(custom)

explode = Explode(Object=pulled_nodes, Component="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")  # -> Position, Orientation, Support, BHoM_Guid, Name, Fragments, Tags, CustomData
explode_2 = Explode(Object=explode.Fragments, Component="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")  # -> Id, PersistentId
explode_3 = Explode(Object=explode.Position, Component="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")  # -> X, Y, Z
entwine = Entwine(Branch00=explode_2.Id, Branch01=explode_3.X, Branch02=explode_3.Y, Branch03=explode_3.Z, FlattenInputs=True)
writexl = WriteToExcel(
    Run=Toggle(True),
    ExcelWorksheet="1",
    ColumnNames=panel_3,
    WriteOptions=wo.WriteOptions,
    ColumnnsOrRows=False,
    DataToWriteIntoColumns=entwine)

# ----
# Show List of Load Cases
number_slider = Slider(275, range=0..1000)
geo_2 = Geometry(<point referenced from the Rhino model>)
Y = UnitY(Factor=number_slider)
neg = Negative(Value=Y)
pt_2 = Point(geo_2)
move = Move(Geometry=pt_2, Motion=neg)  # -> Geometry, Transform
ln = Line(StartPoint=pt_2, EndPoint=move.Geometry)
divide = DivideCurve(Curve=ln, Count=Slider(49, range=0..100), Kinks=False)  # -> Points, Tangents, Parameters
all_cases_and_combos = Data(branch)
X = UnitX(Factor=Slider(75, range=0..100))
arrlinear = LinearArray(Geometry=divide.Points, Direction=X, Count=Slider(4, range=0..10))  # -> simplify(Geometry), Transform
lng_3 = ListLength(List=all_cases_and_combos)
flip = FlipMatrix(Data=arrlinear.Geometry)  # -> flatten(Data)
series = Series(Start=1, Step=1, Count=lng_3)
concat_6 = Concatenate(FragmentA=series, FragmentB=". ", FragmentC=all_cases_and_combos)
short = ShortestList(ListA=flip, ListB=concat_6, TrimMode=2)  # -> ListA, ListB
number_slider_2 = Slider(2.8, range=0.5..5)
geo_3 = Geometry(<point referenced from the Rhino model>)
case_combo_7 = Data(case_combo)
xy_2 = XYPlane(Origin=short.ListA)
pt_3 = Point(geo_3)
xy_3 = XYPlane(Origin=pt_3)
item_6 = ListItem(List=short.ListB, Index=case_combo_7, Wrap=True)
text_2 = DefineText(Text=short.ListB, Plane=xy_2, Size=number_slider_2, Font="Arial")
text_3 = DefineText(Text=short.ListB, Plane=xy_2, Size=number_slider_2, Font="Arial")
item_7 = ListItem(List=text_2, Index=case_combo_7, Wrap=False)
text_4 = DefineText(Text=item_6, Plane=xy_3, Size=Slider(4, range=0.5..5), Font="Arial")
merge = Merge(Data1=flatten(item_7), Data2=flatten(text_4))
material_2 = CreateMaterial(Diffuse=RGBA(143, 143, 143, 113), Specular=RGB(255, 255, 255), Emission=RGB(0, 0, 0), Transparency=0, Shine=0)
material_3 = CreateMaterial(Diffuse=RGBA(0, 0, 0, 113), Specular=RGB(255, 255, 255), Emission=RGB(0, 0, 0), Transparency=0, Shine=0)
preview = CustomPreview(Geometry=text_3, Material=material_2)
preview_2 = CustomPreview(Geometry=merge, Material=material_3)

# ----
# Table Title
lift_3 = Data(lift_2)
addition_2 = Addition(A=lift_3, B=1)
concat_7 = Concatenate(FragmentA="Lift#", FragmentB=addition_2, FragmentC=" Cases and Combindations in SAP2000 Model")
panel_5 = Panel(concat_7)
geo_4 = Geometry(<point referenced from the Rhino model>)
pt_4 = Point(geo_4)
xy_4 = XYPlane(Origin=pt_4)
text_5 = DefineText(Text=panel_5, Plane=xy_4, Size=Slider(4, range=0..10), Font="Arial")
material_4 = CreateMaterial(Diffuse=RGB(0, 0, 0), Specular=RGB(255, 255, 255), Emission=RGB(0, 0, 0), Transparency=0, Shine=0)

# ----
# Show Reaction Results
custom_3 = Data(custom_2)
calculations = Calculations(custom=custom_3)  # -> fx_2, fy_2, fz_2, am, x_axis_2, y_axis_2, z_axis_2, supports_2
fz = Data(calculations.fz_2)
x_axis = Data(calculations.x_axis_2)
fx = Data(calculations.fx_2)
fy = Data(calculations.fy_2)
y_axis = Data(calculations.y_axis_2)
z_axis = Data(calculations.z_axis_2)
supports = Data(calculations.supports_2)
material_5 = CreateMaterial(Diffuse=RGB(255, 0, 0), Specular=RGB(255, 255, 255), Emission=RGB(0, 0, 0), Transparency=0, Shine=0)
material_6 = CreateMaterial(Diffuse=RGB(0, 255, 0), Specular=RGB(255, 255, 255), Emission=RGB(0, 0, 0), Transparency=0, Shine=0)
material_7 = CreateMaterial(Diffuse=RGB(0, 0, 255), Specular=RGB(255, 255, 255), Emission=RGB(0, 0, 0), Transparency=0, Shine=0)
material_8 = CreateMaterial(Diffuse=RGB(255, 0, 0), Specular=RGB(255, 255, 255), Emission=RGB(0, 0, 0), Transparency=0, Shine=0)
material_9 = CreateMaterial(Diffuse=RGB(0, 255, 0), Specular=RGB(255, 255, 255), Emission=RGB(0, 0, 0), Transparency=0, Shine=0)
material_10 = CreateMaterial(Diffuse=RGB(0, 13, 255), Specular=RGB(255, 255, 255), Emission=RGB(0, 0, 0), Transparency=0, Shine=0)
material_11 = CreateMaterial(Diffuse=RGB(0, 0, 0), Specular=RGB(255, 255, 255), Emission=RGB(0, 0, 0), Transparency=Slider(0.7, range=0..1), Shine=0)

panel_6 = Panel(supports)

# ----
# Preview in Rhino
preview_3 = CustomPreview(Geometry=text, Material=material)
preview_4 = CustomPreview(Geometry=text_5, Material=material_4)
preview_5 = CustomPreview(Geometry=fx, Material=material_5)
preview_6 = CustomPreview(Geometry=fy, Material=material_6)
preview_7 = CustomPreview(Geometry=fz, Material=material_7)
preview_8 = CustomPreview(Geometry=x_axis, Material=material_8)
preview_9 = CustomPreview(Geometry=y_axis, Material=material_9)
preview_10 = CustomPreview(Geometry=z_axis, Material=material_10)
preview_11 = CustomPreview(Geometry=supports, Material=material_11)

# ==== cluster ExtractRaw
lift = ClusterInput()
lift_2 = Data(lift)
explode = Explode(Object=lift_2, Component="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")  # -> FX, FY, FZ, MX, MY, MZ, ObjectId, ResultCase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
division = Division(A=explode.FX, B=1000)
division_2 = Division(A=explode.FY, B=1000)
division_3 = Division(A=explode.FZ, B=1000)
division_4 = Division(A=explode.MX, B=1000)
division_5 = Division(A=explode.MY, B=1000)
division_6 = Division(A=explode.MZ, B=1000)
panel = Panel("""Node ID
Result Case
Fx (kN)
Fy (kN)
Fz (kN)
Mx (kNm)
My (kNm)
Mz (kNm)""")
entwine = Entwine(
    Branch00=explode.ObjectId,
    Branch01=explode.ResultCase,
    Branch02=division,
    Branch03=division_2,
    Branch04=division_3,
    Branch05=division_4,
    Branch06=division_5,
    Branch07=division_6,
    FlattenInputs=True)  # -> simplify(Result)
merge = Merge(Data1=simplify(graft(panel)), Data2=entwine)
flip = FlipMatrix(Data=merge)
tocsv = Data(flip)
tocsv_2 = ClusterOutput(tocsv)

# ==== cluster Calculations
custom = ClusterInput()
custom_2 = Data(custom)
explode = Explode(Object=custom_2, Component="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")  # -> Results, Position, Name, Tags, BHoM_Guid
pt = Point(flatten(explode.Position))
pgroups = PointGroups(Points=pt, Distance="4")  # -> simplify(Groups), simplify(Indices)
data = Data(pgroups.Groups)
item = ListItem(List=flatten(explode.Results), Index=pgroups.Indices, Wrap=True)
avr = Average(Input=data)  # -> flatten(ArithmeticMean)
list = ValueList({"FX", "FY", "FZ"}, selected="FX")
list_2 = ValueList({"FX", "FY", "FZ"}, selected="FY")
list_3 = ValueList({"FX", "FY", "FZ"}, selected="FZ")
request = Data(list)
request_2 = Data(list_2)
request_3 = Data(list_3)
request_4 = Data(request)
request_5 = Data(request_2)
request_6 = Data(request_3)
getproperty = GetProperty(Obj=item, PropName=request_6, Component="{ .GetProperty")
getproperty_2 = GetProperty(Obj=item, PropName=request_5, Component="{ .GetProperty")
getproperty_3 = GetProperty(Obj=item, PropName=request_4, Component="{ .GetProperty")
ma = MassAddition(Input=getproperty)  # -> flatten(Result), PartialResults
ma_2 = MassAddition(Input=getproperty_2)  # -> flatten(Result), PartialResults
ma_3 = MassAddition(Input=getproperty_3)  # -> flatten(Result), PartialResults
X = UnitX(Factor=Slider(4, range=0..100))
division = Division(A=ma.Result, B=1000)
division_2 = Division(A=ma_2.Result, B=1000)
move = Move(Geometry=avr, Motion=X)  # -> Geometry, Transform
division_3 = Division(A=ma_3.Result, B=1000)
c_script = CSharpScript(x=request)  # -> out, A; inputs x: String
# ---------- c_script: C# ----------
    string units = " kN";

    if(x.Contains("M"))
    {
      units = " kNm";
    }

    A = units;
# ---------- end c_script ----------
round = Round(Number=division)  # -> Nearest, Floor, Ceiling
c_script_2 = CSharpScript(x=request)  # -> out, A; inputs x: String; same code as c_script
c_script_3 = CSharpScript(x=request)  # -> out, A; inputs x: String; same code as c_script
round_2 = Round(Number=division_2)  # -> Nearest, Floor, Ceiling
round_3 = Round(Number=division_3)  # -> Nearest, Floor, Ceiling
Y = UnitY(Factor=Slider(2.5, range=0..10))
Y_2 = UnitY(Factor=Slider(6, range=0..100))
Y_3 = UnitY(Factor=1)
c_script_4 = CSharpScript(x=round.Nearest)  # -> out, A; inputs x: Double
# ---------- c_script_4: C# ----------
    string sign = " (Down)";

    if(x > 0)
    {
      sign = " (Up)";
    }

    A = sign;
# ---------- end c_script_4 ----------
move_2 = Move(Geometry=avr, Motion=expr("-x", Y))  # -> Geometry, Transform
move_3 = Move(Geometry=avr, Motion=Y_2)  # -> Geometry, Transform
move_4 = Move(Geometry=move.Geometry, Motion=Y_3)  # -> Geometry, Transform
concat = Concatenate(FragmentB=round_2.Nearest, FragmentC=c_script_2.A)
concat_2 = Concatenate(FragmentB=round_3.Nearest, FragmentC=c_script_3.A)
X_2 = UnitX(Factor=Slider(4, range=0..10))
X_3 = UnitX(Factor=Slider(4, range=0..10))
concat_3 = Concatenate(FragmentB=round.Nearest, FragmentC=c_script.A)
move_5 = Move(Geometry=move_3.Geometry, Motion=expr("-x", X_2))  # -> Geometry, Transform
move_6 = Move(Geometry=move_2.Geometry, Motion=expr("-x", X_3))  # -> Geometry, Transform
Y_4 = UnitY(Factor=Slider(2.5, range=0..10))
clean_useless_results = CSharpScript(x=round_3.Nearest, y=round_2.Nearest, z=round.Nearest)  # -> out, A; inputs x: Double, y: Double, z: Double
# ---------- clean_useless_results: C# ----------
    bool result = false;
    
    if(x == 0 && y == 0 && z == 0)
    {
      result = true; 
    }
    A = result;
# ---------- end clean_useless_results ----------
move_7 = Move(Geometry=move_6.Geometry, Motion=expr("-x", Y_4))  # -> Geometry, Transform
pt_2 = Point(pgroups.Groups)
xy = XYPlane(Origin=move_4.Geometry)
xy_2 = XYPlane(Origin=move_5.Geometry)
xy_3 = XYPlane(Origin=pt_2)
text_size = Data(Slider(1.5, range=0.1..2))
xy_4 = XYPlane(Origin=move_6.Geometry)
xy_5 = XYPlane(Origin=move_7.Geometry)
cir = Circle(Plane=xy_3, Radius=0.35)
text = DefineText(Text=concat, Plane=xy_2, Size=text_size, Font="Arial")
data_2 = Data(data)
text_2 = DefineText(Text=concat_2, Plane=xy, Size=text_size, Font="Arial")
text_3 = DefineText(Text=concat_3, Plane=xy_4, Size=text_size, Font="Arial")
text_4 = DefineText(Text=c_script_4.A, Plane=xy_5, Size=text_size, Font="Arial")
boundary = BoundarySurfaces(Edges=cir)
cluster = Cluster(data=data_2)  # -> x_arrow_2, X_3, y_arrow_2, Y_3, Z_5
cull = CullPattern(List=text, CullPattern=invert(clean_useless_results.A))
area = Area(Geometry=cluster.X_3)  # -> Area, Centroid
cull_2 = CullPattern(List=text_2, CullPattern=invert(clean_useless_results.A))
cull_3 = CullPattern(List=text_3, CullPattern=invert(clean_useless_results.A))
cull_4 = CullPattern(List=text_4, CullPattern=invert(clean_useless_results.A))
tstat = TreeStatistics(Tree=boundary)  # -> Paths, Length, Count
cull_5 = CullPattern(List=cluster.x_arrow_2, CullPattern=invert(clean_useless_results.A))
cull_6 = CullPattern(List=cluster.X_3, CullPattern=invert(clean_useless_results.A))
cull_7 = CullPattern(List=cluster.y_arrow_2, CullPattern=invert(clean_useless_results.A))
cull_8 = CullPattern(List=cluster.Y_3, CullPattern=invert(clean_useless_results.A))
Z = Data(cluster.Z_5)
merge = Merge(Data1=flatten(cull_3), Data2=flatten(cull_4))
cull_9 = CullPattern(List=tstat.Paths, CullPattern=invert(clean_useless_results.A))
fy = Data(cull)
fx = Data(cull_2)
x_arrow = Data(cull_5)
X_4 = Data(cull_6)
y_arrow = Data(cull_7)
Y_5 = Data(cull_8)
cull_10 = CullPattern(List=Z, CullPattern=invert(clean_useless_results.A))
branch = TreeBranch(Tree=boundary, Path=cull_9, MaintainPaths=True)
fy_2 = ClusterOutput(fy)
fx_2 = ClusterOutput(fx)
fz = Data(merge)
merge_2 = Merge(Data1=flatten(x_arrow), Data2=flatten(X_4))
merge_3 = Merge(Data1=flatten(y_arrow), Data2=flatten(Y_5))
am = ClusterOutput(avr)
fz_2 = ClusterOutput(fz)
supports = Data(branch)
z_axis = Data(cull_10)
y_axis = Data(merge_3)
x_axis = Data(merge_2)
supports_2 = ClusterOutput(supports)
z_axis_2 = ClusterOutput(z_axis)
y_axis_2 = ClusterOutput(y_axis)
x_axis_2 = ClusterOutput(x_axis)

# ==== cluster Custom
pulled_results = ClusterInput()
pulled_nodes = ClusterInput()
pulled_results_2 = Data(pulled_results)
pulled_nodes_2 = Data(pulled_nodes)
getproperty = GetProperty(Obj=pulled_nodes_2, PropName="Fragments.Id", Component="{ .GetProperty")  # -> flatten(Value)
getproperty_2 = GetProperty(Obj=pulled_results_2, PropName="ObjectId", Component="{ .GetProperty")
mindex = MemberIndex(Set=getproperty, Member=getproperty_2)  # -> flatten(Index), Count
item = ListItem(List=pulled_nodes_2, Index=mindex.Index, Wrap=True)
getproperty_3 = GetProperty(Obj=item, PropName="Position", Component="{ .GetProperty")
createcustom = CreateCustom(Results=pulled_results_2, Position=getproperty_3, Component="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")
cset = CreateSet(List=getproperty_2)  # -> Set, Map
tree = CreateTree(Data=createcustom, Path=cset.Map)
item_2 = ListItem(List=tree, Index=0, Wrap=True)
custom = Data(item_2)
custom_2 = ClusterOutput(custom)

# ==== cluster Cluster
data = ClusterInput()
data_2 = Data(data)
avr = Average(Input=data_2)  # -> flatten(ArithmeticMean)
number_slider = Slider(5, range=0..100)
X = UnitX(Factor=number_slider)
Y = UnitY(Factor=number_slider)
_4 = Move(Geometry=avr, Motion=X)  # -> Geometry, Transform
_4_2 = Move(Geometry=avr, Motion=Y)  # -> Geometry, Transform
ln = Line(StartPoint=avr, EndPoint=_4.Geometry)
multiplication = Multiplication(A=X, B=-0.1)
ln_2 = Line(StartPoint=avr, EndPoint=_4_2.Geometry)
multiplication_2 = Multiplication(A=Y, B=-0.1)
_2 = Move(Geometry=_4.Geometry, Motion=multiplication)  # -> Geometry, Transform
_2_2 = Move(Geometry=_4_2.Geometry, Motion=multiplication_2)  # -> Geometry, Transform
multiplication_3 = Multiplication(A=multiplication_2, B=0.5)
multiplication_4 = Multiplication(A=multiplication, B=0.5)
Z = UnitZ(Factor=1)
_3 = Move(Geometry=_2.Geometry, Motion=multiplication_3)  # -> Geometry, Transform
Z_2 = UnitZ(Factor=1)
extr = Extrude(Base=ln, Direction=Z)
_1 = Move(Geometry=_2_2.Geometry, Motion=multiplication_4)  # -> Geometry, Transform
extr_2 = Extrude(Base=ln_2, Direction=Z_2)
_1_2 = Mirror(Geometry=_3.Geometry, Plane=extr)  # -> Geometry, Transform
_3_2 = Mirror(Geometry=_1.Geometry, Plane=extr_2)  # -> Geometry, Transform
cir = Circle(Plane=simplify(graft(avr)), Radius=Slider(0.15, range=0..1))
ln_3 = Line(StartPoint=avr, EndPoint=_2.Geometry)
srf4pt = _4PointSurface(CornerA=_1_2.Geometry, CornerB=_2.Geometry, CornerC=_3.Geometry, CornerD=_4.Geometry)
srf4pt_2 = _4PointSurface(CornerA=_1.Geometry, CornerB=_2_2.Geometry, CornerC=_3_2.Geometry, CornerD=_4_2.Geometry)
ln_4 = Line(StartPoint=avr, EndPoint=_2_2.Geometry)
pipe = Pipe(Curve=ln_3, Radius=0.1, Caps=0)
boundary = BoundarySurfaces(Edges=cir)
Z_3 = UnitZ(Factor=1)
pipe_2 = Pipe(Curve=ln_4, Radius=0.1, Caps=0)
tstat = TreeStatistics(Tree=simplify(pipe))  # -> simplify(Paths), Length, Count
tstat_2 = TreeStatistics(Tree=simplify(pipe_2))  # -> simplify(Paths), Length, Count
extr_3 = Extrude(Base=boundary, Direction=Z_3)
area = Area(Geometry=pipe)  # -> Area, Centroid
area_2 = Area(Geometry=pipe_2)  # -> Area, Centroid
tstat_3 = TreeStatistics(Tree=simplify(extr_3))  # -> simplify(Paths), Length, Count
tag = TextTag(Location=flatten(area.Centroid), Text=tstat.Paths)
Z_4 = Data(flatten(extr_3))
area_3 = Area(Geometry=extr_3)  # -> Area, Centroid
X_2 = Data(flatten(pipe))
tag_2 = TextTag(Location=flatten(area_2.Centroid), Text=tstat_2.Paths)
x_arrow = Data(srf4pt)
Y_2 = Data(flatten(pipe_2))
y_arrow = Data(srf4pt_2)
tag_3 = TextTag(Location=flatten(area_3.Centroid), Text=tstat_3.Paths)
Z_5 = ClusterOutput(Z_4)
x_arrow_2 = ClusterOutput(x_arrow)
X_3 = ClusterOutput(X_2)
Y_3 = ClusterOutput(Y_2)
y_arrow_2 = ClusterOutput(y_arrow)
