# Grasshopper definition ExcelGrasshopperVisualisation.gh (Grasshopper 1.0.7)
# plug-ins: EleFront, TT Toolbox

# ---- group: Chosen Parameters Input
export_property_1_u1_2_u2_3_u3_4_r1_5_r2 = Panel("3")  # "Export Property, (1 = U1, 2 = U2, 3 = U3, 4 = R1, 5 = R2, 6 = R3)"
node_numbers = Panel("""273
450
602
1731
3586
4375
5150
7271
8564
TG50
11711
14296
17549
26221
TG504
N26335
148""")
stage_number = Panel("200")

# ----
panel = Panel("M:\Job\J3908 - T2 Expansion\Engineering\04 Temporary Works\M04.11 - Precamber and Preset of T2 Roof\__Computation\t2_roof_separator\t2_roof_geometry.xlsx")
module_number = ValueList({"1", "2", "3", "4", "5", "6", "7", "8", "9", "10", "11", "12", "13", "14", "15", "16", "17", "18", "19", "20", "21"}, selected="1")

# ---- group: File Location Input
displacement_sheet_location = Panel("C:\Users\brendanlia\Desktop\Joint Data\Joint_Displacement.xlsx")
coordinate_sheet_loction = Panel("C:\Users\brendanlia\Desktop\Joint Data\Joint_Coordinates.xlsx")

# ----
read_excel_sheet = ReadExcelSheet(Run=Toggle(True), FilePath=panel, Worksheet="1", Listen=False)  # -> UserMessages, Columns, Rows
cull_index = CullIndex(List=read_excel_sheet.Columns, Indices="0", Wrap=True)
tree_branch = TreeBranch(Tree=cull_index, Path="{4;0}", MaintainPaths=True)
tree_branch_2 = TreeBranch(Tree=cull_index, Path="{3;0}", MaintainPaths=True)
tree_branch_3 = TreeBranch(Tree=cull_index, Path="{2;0}", MaintainPaths=True)
construct_point = ConstructPoint(XCoordinate=tree_branch_3, YCoordinate=tree_branch_2, ZCoordinate=tree_branch)  # -> flatten(Point)

read_excel_sheet_2 = ReadExcelSheet(Run=Toggle(True), FilePath=panel, Worksheet="2", Listen=False)  # -> UserMessages, Columns, Rows
cull_index_2 = CullIndex(List=read_excel_sheet_2.Columns, Indices="0", Wrap=True)
tree_branch_4 = TreeBranch(Tree=cull_index_2, Path="{2;0}", MaintainPaths=True)
tree_branch_5 = TreeBranch(Tree=cull_index, Path="{1;0}", MaintainPaths=True)
tree_branch_6 = TreeBranch(Tree=cull_index_2, Path="{3;0}", MaintainPaths=True)
member_index = MemberIndex(Set=tree_branch_5, Member=tree_branch_6)  # -> flatten(Index), Count
member_index_2 = MemberIndex(Set=tree_branch_5, Member=tree_branch_4)  # -> flatten(Index), Count
tree_item_index = TreeItemIndex(DataTree=construct_point, BranchIndex=0, ItemIndex=member_index_2.Index)
tree_item_index_2 = TreeItemIndex(DataTree=construct_point, BranchIndex=0, ItemIndex=member_index.Index)
line = Line(StartPoint=tree_item_index, EndPoint=tree_item_index_2)

# ---- group: Read Coordinates Sheet
read_excel_sheet_3 = ReadExcelSheet(Run=Toggle(True), FilePath=coordinate_sheet_loction, Worksheet="1", Listen=False)  # -> UserMessages, Columns, Rows
shift_list = ShiftList(List=read_excel_sheet_3.Columns, Shift="3", Wrap=True)  # -> simplify(List)

# ---- group: Find Index of Chosen Nodes
tree_branch_7 = TreeBranch(Tree=shift_list, Path="{1}", MaintainPaths=True)
member_index_3 = MemberIndex(Set=tree_branch_7, Member=node_numbers)  # -> Index, Count

# ----
subtraction = Subtraction(A=module_number, B="1")

# ---- group: Extract XYZ coords
tree_branch_8 = TreeBranch(Tree=shift_list, Path="8", MaintainPaths=True)
tree_branch_9 = TreeBranch(Tree=shift_list, Path="10", MaintainPaths=True)
tree_branch_10 = TreeBranch(Tree=shift_list, Path="9", MaintainPaths=True)

# ----
panel_2 = Panel(construct_point)
bottom_left_coord = Panel("""{-227, -166.6, 0}
{-180,-166.6, 0}
{-144,-166.6, 0}
{-108,-166.6, 0}
{-72,-166.6, 0}
{-36,-166.6, 0}
{0,-166.6, 0}
{-227, -90, 0}
{-180,-90, 0}
{-144,-90, 0}
{-108,-90, 0}
{-72,-90, 0}
{-36,-90, 0}
{0,-90, 0}
{-227, -19.45, 0}
{-180,-19.45, 0}
{-144,-19.45, 0}
{-108,-19.45, 0}
{-72,-19.45, 0}
{-36,-19.45, 0}
{0,-19.45, 0}""")
top_right_coord = Panel("""{-178.5, -88.5, 0}
{-143, -88.5, 0}
{-108, -88.5, 0}
{-70.5, -88.5, 0}
{-34.5, -88.5, 0}
{0, -88.5, 0}
{45.4, -88.5, 0}
{-178.5, -16.5, 0}
{-143, -16.5, 0}
{-108, -16.5, 0}
{-70.5, -16.5, 0}
{-34.5, -16.5, 0}
{0, -16.5, 0}
{45.4, -16.5, 0}
{-178.5, 64.6, 0}
{-143, 64.6, 0}
{-108, 64.6, 0}
{-70.5, 64.6, 0}
{-34.5, 64.6, 0}
{0, 64.6, 0}
{45.4, 64.6, 0}""")

# ---- group: Read Displacement Sheet
read_excel_sheet_4 = ReadExcelSheet(Run=Toggle(True), FilePath=displacement_sheet_location, Worksheet="1", Listen=False)  # -> UserMessages, Columns, Rows
shift_list_2 = ShiftList(List=read_excel_sheet_4.Columns, Shift="3", Wrap=True)  # -> simplify(List)

# ----
tree_item_index_3 = TreeItemIndex(DataTree=bottom_left_coord, BranchIndex=0, ItemIndex=subtraction)
tree_item_index_4 = TreeItemIndex(DataTree=top_right_coord, BranchIndex=0, ItemIndex=subtraction)

# ---- group: Exctracted Chosen XYZ indexes
tree_item_index_5 = TreeItemIndex(DataTree=tree_branch_8, BranchIndex=0, ItemIndex=member_index_3.Index)
tree_item_index_6 = TreeItemIndex(DataTree=tree_branch_9, BranchIndex=0, ItemIndex=member_index_3.Index)
tree_item_index_7 = TreeItemIndex(DataTree=tree_branch_10, BranchIndex=0, ItemIndex=member_index_3.Index)
flatten_tree = FlattenTree(Tree=tree_item_index_6, Path="{0}")
flatten_tree_2 = FlattenTree(Tree=tree_item_index_5, Path="{0}")
flatten_tree_3 = FlattenTree(Tree=tree_item_index_7, Path="{0}")
construct_point_2 = ConstructPoint(XCoordinate=flatten_tree_2, YCoordinate=flatten_tree_3, ZCoordinate=flatten_tree)

# ----
line_2 = Line(line)
xy_plane = XYPlane(Origin=Point(0, 0, 0))

# ---- group: Find Intersect of Stage Number and Node Number
tree_branch_11 = TreeBranch(Tree=shift_list_2, Path="{1}", MaintainPaths=True)
tree_branch_12 = TreeBranch(Tree=shift_list_2, Path="{5}", MaintainPaths=True)
member_index_4 = MemberIndex(Set=tree_branch_12, Member=stage_number)  # -> Index, Count
member_index_5 = MemberIndex(Set=tree_branch_11, Member=node_numbers)  # -> Index, Count
set_intersection = SetIntersection(SetA=member_index_5.Index, SetB=member_index_4.Index)

# ----
end_points = EndPoints(Curve=line_2)  # -> Start, End

addition = Addition(A=export_property_1_u1_2_u2_3_u3_4_r1_5_r2, B="6")
tree_branch_13 = TreeBranch(Tree=shift_list_2, Path=addition, MaintainPaths=True)

rectangle_2pt = Rectangle2Pt(Plane=xy_plane, PointA=tree_item_index_3, PointB=tree_item_index_4, Radius=0)  # -> Rectangle, Length
point_in_curve = PointInCurve(Point=end_points.Start, Curve=rectangle_2pt.Rectangle)  # -> Relationship, Point
division = Division(A=construct_point_2, B=1000)
equality = Equality(FirstNumber=point_in_curve.Relationship, SecondNumber="2")  # -> Equality, Inequality

# ---- group: Match Displacement Index and Create Text Dot
tree_item_index_8 = TreeItemIndex(DataTree=tree_branch_13, BranchIndex=0, ItemIndex=set_intersection)
addition_2 = Addition(A=flatten_tree_2, B="600")
addition_3 = Addition(A=flatten_tree_3, B="600")
addition_4 = Addition(A=flatten_tree, B="42500")
flatten_tree_4 = FlattenTree(Tree=tree_item_index_8, Path="{0}")
construct_point_3 = ConstructPoint(XCoordinate=addition_2, YCoordinate=addition_3, ZCoordinate="42500")

# ----
cull_pattern = CullPattern(List=line_2, CullPattern=equality.Equality)
panel_3 = Panel(cull_pattern)
division_2 = Division(A=construct_point_3, B=1000)

# ---- group: Layer Designation
define_object_attributes = DefineObjectAttributes(Layer="Points")

# ---- group: Formatting
number = Number(flatten_tree_4)
format = Format(Format="{0:0.00}", Culture=127, Data0=number)

# ---- group: Bake Objects onto Rhino
bake_objects = BakeObjects(Geometry=division, BakeName="Points", Bake=False)

# ---- group: Text Parameters
text_tag_3d = TextTag3D(Location=division_2, Text=format, Size="1.2", Colour="Black", Justification=7)
