# Dynamo graph Full Beam Dynamo.dyn (Dynamo 2.1.0.7500)

# group: Standard Module B - Leftmost
x_coord_start_point = CodeBlock { -20000; }
length_of_truss = DoubleSlider(10500, range=0..52500 step 1)
code_block = CodeBlock { 3000; }
byCoordinates = Point.ByCoordinates(x=x_coord_start_point, z=code_block)
byCoordinates_2 = Vector.ByCoordinates(x=length_of_truss)
add = Point.Add(point=byCoordinates, vectorToAdd=byCoordinates_2)
byStartPointEndPoint = Line.ByStartPointEndPoint(startPoint=byCoordinates, endPoint=add)

# group: Line Splitting Ratios
number_of_triangles = IntegerSlider(3, range=0..15 step 1)
code_block_2 = CodeBlock { 1; }
div = code_block_2 / number_of_triangles
code_block_3 = CodeBlock(x=number_of_triangles) { x-1; }
sequence = Sequence(start=div, amount=code_block_3, step=div, lacing=Shortest)

# group: Line Splitting Ratios
number_of_triangles_2 = IntegerSlider(3, range=0..15 step 1)
code_block_4 = CodeBlock { 1; }
div_2 = code_block_4 / number_of_triangles_2
code_block_5 = CodeBlock(x=number_of_triangles_2) { x-1; }
sequence_2 = Sequence(start=div_2, amount=code_block_5, step=div_2, lacing=Shortest)

# group: Line Splitting Ratios
number_of_triangles_3 = IntegerSlider(3, range=0..15 step 1)
code_block_6 = CodeBlock { 1; }
div_3 = code_block_6 / number_of_triangles_3
code_block_7 = CodeBlock(x=number_of_triangles_3) { x-1; }
sequence_3 = Sequence(start=div_3, amount=code_block_7, step=div_3, lacing=Shortest)

# group: Upper Line Splitting Designation
code_block_8 = CodeBlock { 1; }
code_block_9 = CodeBlock(x=number_of_triangles_3) { 2*x; }
div_4 = code_block_8 / code_block_9
code_block_10 = CodeBlock(x=number_of_triangles_3) { 2*x-1; }
sequence_4 = Sequence(start=div_4, amount=code_block_10, step=div_4)
splitByParameter = Curve.SplitByParameter(curve=byStartPointEndPoint, parameters=sequence_4)

# group: Extract Relevant Points and Specify upper beam translation
vertical_length_height = DoubleSlider(-3000, range=-3000..3000 step 0.1)
translate = Geometry.Translate(geometry=splitByParameter, zTranslation=vertical_length_height)
code_block_11 = CodeBlock { 2; }
code_block_12 = CodeBlock { 0; }
takeEveryNthItem = List.TakeEveryNthItem(list=translate, n=code_block_11, offset=code_block_12)
endPoint = Curve.EndPoint(curve=takeEveryNthItem)
startPoint = Curve.StartPoint(curve=takeEveryNthItem)
translate_2 = Geometry.Translate(geometry=byStartPointEndPoint, zTranslation=vertical_length_height)

# group: Mirror Distance
midpoint_displacement = DoubleSlider(750, range=0..750 step 0.1)

# group: Specify y-axis mirror plane
code_block_13 = CodeBlock { 0; }
code_block_14 = CodeBlock { 0; }
byCoordinates_3 = Point.ByCoordinates(x=code_block_13, y=midpoint_displacement, z=code_block_14)
YAxis = Vector.YAxis()
byOriginNormal = Plane.ByOriginNormal(origin=byCoordinates_3, normal=YAxis)

# group: Beam Specifications
horizontal_main_beam = StructuralFramingTypes("610x305x238UB")  # "Horizontal Main Beam Specification"
diagonal_beam_specification = StructuralFramingTypes("305x305x137UC")
upper_interbeam_specification = StructuralFramingTypes("305x305x137UC")
lower_interbeam_specification = StructuralFramingTypes("203x203x46UC")

# group: Mirror Distance
midpoint_displacement_2 = DoubleSlider(750, range=0..750 step 0.1)

# group: Specify y-axis mirror plane
code_block_15 = CodeBlock { 0; }
code_block_16 = CodeBlock { 0; }
byCoordinates_4 = Point.ByCoordinates(x=code_block_15, y=midpoint_displacement_2, z=code_block_16)
YAxis_2 = Vector.YAxis()
byOriginNormal_2 = Plane.ByOriginNormal(origin=byCoordinates_4, normal=YAxis_2)

# group: Beam Specifications
diagonal_beam_specification_2 = StructuralFramingTypes("305x305x137UC")
horizontal_main_beam_2 = StructuralFramingTypes("610x305x238UB")  # "Horizontal Main Beam Specification"
upper_interbeam_specification_2 = StructuralFramingTypes("305x305x137UC")
lower_interbeam_specification_2 = StructuralFramingTypes("203x203x46UC")

# group: Mirror Distance
midpoint_displacement_3 = DoubleSlider(750, range=0..750 step 0.1)

# group: Specify y-axis mirror plane
code_block_17 = CodeBlock { 0; }
code_block_18 = CodeBlock { 0; }
byCoordinates_5 = Point.ByCoordinates(x=code_block_17, y=midpoint_displacement_3, z=code_block_18)
YAxis_3 = Vector.YAxis()
byOriginNormal_3 = Plane.ByOriginNormal(origin=byCoordinates_5, normal=YAxis_3)

# group: Beam Specifications
diagonal_beam_specification_3 = StructuralFramingTypes("305x305x118UC")
horizontal_main_beam_3 = StructuralFramingTypes("610x305x238UB")  # "Horizontal Main Beam Specification"
upper_interbeam_specification_3 = StructuralFramingTypes("305x305x118UC")
lower_interbeam_specification_3 = StructuralFramingTypes("203x203x46UC")

# group: Standard Module A, left
x_coord_start_point_2 = CodeBlock { 10500; }
code_block_19 = CodeBlock { 3000; }
length_of_truss_2 = DoubleSlider(10500, range=0..52500 step 1)
byCoordinates_6 = Vector.ByCoordinates(x=length_of_truss_2)

# group: Relationary Addition
add_2 = x_coord_start_point + length_of_truss
add_3 = add_2 + length_of_truss_2

# group (continued): Standard Module A, left
byCoordinates_7 = Point.ByCoordinates(x=add_2, z=code_block_19)
add_4 = Point.Add(point=byCoordinates_7, vectorToAdd=byCoordinates_6)
byStartPointEndPoint_2 = Line.ByStartPointEndPoint(startPoint=byCoordinates_7, endPoint=add_4)

# group: Upper Line Splitting Designation
code_block_20 = CodeBlock { 1; }
code_block_21 = CodeBlock(x=number_of_triangles) { 2*x; }
div_5 = code_block_20 / code_block_21
code_block_22 = CodeBlock(x=number_of_triangles) { 2*x-1; }
sequence_5 = Sequence(start=div_5, amount=code_block_22, step=div_5)
splitByParameter_2 = Curve.SplitByParameter(curve=byStartPointEndPoint_2, parameters=sequence_5)

# group: Extract Relevant Points and Specify upper beam translation
vertical_length_height_2 = DoubleSlider(-3000, range=-3000..3000 step 0.1)
translate_3 = Geometry.Translate(geometry=splitByParameter_2, zTranslation=vertical_length_height_2)
code_block_23 = CodeBlock { 2; }
code_block_24 = CodeBlock { 0; }
takeEveryNthItem_2 = List.TakeEveryNthItem(list=translate_3, n=code_block_23, offset=code_block_24)
endPoint_2 = Curve.EndPoint(curve=takeEveryNthItem_2)
startPoint_2 = Curve.StartPoint(curve=takeEveryNthItem_2)
translate_4 = Geometry.Translate(geometry=byStartPointEndPoint_2, zTranslation=vertical_length_height_2)

# group: Non-Standard Module C
code_block_25 = CodeBlock { 3000; }
byCoordinates_8 = Point.ByCoordinates(x=add_3, z=code_block_25)
length_of_truss_3 = DoubleSlider(12000, range=0..126000 step 1)
byCoordinates_9 = Vector.ByCoordinates(x=length_of_truss_3)
add_5 = Point.Add(point=byCoordinates_8, vectorToAdd=byCoordinates_9)
byStartPointEndPoint_3 = Line.ByStartPointEndPoint(startPoint=byCoordinates_8, endPoint=add_5)

# group: Upper Line Splitting Designation
code_block_26 = CodeBlock { 1; }
code_block_27 = CodeBlock(x=number_of_triangles_2) { 2*x; }
div_6 = code_block_26 / code_block_27
code_block_28 = CodeBlock(x=number_of_triangles_2) { 2*x-1; }
sequence_6 = Sequence(start=div_6, amount=code_block_28, step=div_6)
splitByParameter_3 = Curve.SplitByParameter(curve=byStartPointEndPoint_3, parameters=sequence_6)

# group: Extract Relevant Points and Specify upper beam translation
vertical_length_height_3 = DoubleSlider(-3000, range=-3000..3000 step 0.1)
translate_5 = Geometry.Translate(geometry=splitByParameter_3, zTranslation=vertical_length_height_3)
code_block_29 = CodeBlock { 2; }
code_block_30 = CodeBlock { 0; }
takeEveryNthItem_3 = List.TakeEveryNthItem(list=translate_5, n=code_block_29, offset=code_block_30)
endPoint_3 = Curve.EndPoint(curve=takeEveryNthItem_3)
startPoint_3 = Curve.StartPoint(curve=takeEveryNthItem_3)
translate_6 = Geometry.Translate(geometry=byStartPointEndPoint_3, zTranslation=vertical_length_height_3)

# group (continued): Relationary Addition
add_6 = add_3 + length_of_truss_3
add_7 = add_6 + length_of_truss_2

# group: Shoulder Struts
byCoordinates_10 = Point.ByCoordinates(x=x_coord_start_point)
code_block_31 = CodeBlock { 750; }
byCoordinates_11 = Vector.ByCoordinates(y=code_block_31)
add_8 = Point.Add(point=byCoordinates_10, vectorToAdd=byCoordinates_11)
code_block_32 = CodeBlock { -5000; }
byCoordinates_12 = Vector.ByCoordinates(y=code_block_32)
add_9 = Point.Add(point=byCoordinates_10, vectorToAdd=byCoordinates_12)
byStartPointEndPoint_4 = Line.ByStartPointEndPoint(startPoint=add_8, endPoint=add_9)
mirror = Geometry.Mirror(geometry=byStartPointEndPoint_4, mirrorPlane=byOriginNormal)
list_create = List.Create(item0=mirror, item1=byStartPointEndPoint_4)
add_10 = add_7 + length_of_truss
add_11 = add_10 + x_coord_start_point
code_block_33 = CodeBlock { 2; }
div_7 = add_11 / code_block_33
levels = Levels("Level 1")
diagonal_beam_specification_4 = StructuralFramingTypes("254x146x37UB")
code_block_34 = CodeBlock { 0.5; }
mul = code_block_32 * code_block_34
byCoordinates_13 = Vector.ByCoordinates(y=mul)
add_12 = Point.Add(point=byCoordinates_10, vectorToAdd=byCoordinates_13)
code_block_35 = CodeBlock { 3500; }
byCoordinates_14 = Vector.ByCoordinates(x=code_block_35)
add_13 = Point.Add(point=byCoordinates_10, vectorToAdd=byCoordinates_14)
byStartPointEndPoint_5 = Line.ByStartPointEndPoint(startPoint=add_12, endPoint=add_13)
mirror_2 = Geometry.Mirror(geometry=byStartPointEndPoint_5, mirrorPlane=byOriginNormal)
list_create_2 = List.Create(item0=mirror_2, item1=byStartPointEndPoint_5)
levels_2 = Levels("Level 1")
diagonal_beam_specification_5 = StructuralFramingTypes("305x305x158UC")
code_block_36 = CodeBlock { 1750; }
code_block_37 = CodeBlock { 2; }
mul_2 = code_block_37 * midpoint_displacement
byCoordinates_15 = Vector.ByCoordinates(x=code_block_36, y=mul_2)
add_14 = Point.Add(point=add_13, vectorToAdd=byCoordinates_15)
byStartPointEndPoint_6 = Line.ByStartPointEndPoint(startPoint=add_13, endPoint=add_14)
mirror_3 = Geometry.Mirror(geometry=byStartPointEndPoint_6, mirrorPlane=byOriginNormal)
list_create_3 = List.Create(item0=mirror_3, item1=byStartPointEndPoint_6)
levels_3 = Levels("Level 1")
diagonal_beam_specification_6 = StructuralFramingTypes("152x152x30UC")

# group: Specify x-axis mirror plane
code_block_38 = CodeBlock { 0; }
code_block_39 = CodeBlock { 0; }
byCoordinates_16 = Point.ByCoordinates(x=div_7, y=code_block_38, z=code_block_39)
XAxis = Vector.XAxis()
byOriginNormal_4 = Plane.ByOriginNormal(origin=byCoordinates_16, normal=XAxis)

# group (continued): Shoulder Struts
mirror_4 = Geometry.Mirror(geometry=list_create, mirrorPlane=byOriginNormal_4)
list_create_4 = List.Create(item0=mirror_4, item1=mirror, item2=byStartPointEndPoint_4)
flatten = List.Flatten(list=list_create_4)
beamByCurve = StructuralFraming.BeamByCurve(curve=flatten, level=levels, structuralFramingType=diagonal_beam_specification_4)
mirror_5 = Geometry.Mirror(geometry=list_create_2, mirrorPlane=byOriginNormal_4)
list_create_5 = List.Create(item0=mirror_5, item1=mirror_2, item2=byStartPointEndPoint_5)
flatten_2 = List.Flatten(list=list_create_5)
beamByCurve_2 = StructuralFraming.BeamByCurve(curve=flatten_2, level=levels_2, structuralFramingType=diagonal_beam_specification_5)
mirror_6 = Geometry.Mirror(geometry=list_create_3, mirrorPlane=byOriginNormal_4)
list_create_6 = List.Create(item0=mirror_6, item1=list_create_3)
flatten_3 = List.Flatten(list=list_create_6)
beamByCurve_3 = StructuralFraming.BeamByCurve(curve=flatten_3, level=levels_3, structuralFramingType=diagonal_beam_specification_6)
list_create_7 = List.Create(item0=beamByCurve, item1=beamByCurve_2, item2=beamByCurve_3)

# group: Horizontal Main Beam Specifications
levels_4 = Levels("Level 1")
list_create_8 = List.Create(item0=translate_2, item1=byStartPointEndPoint)
flatten_4 = List.Flatten(list=list_create_8)
mirror_7 = Geometry.Mirror(geometry=flatten_4, mirrorPlane=byOriginNormal)
list_create_9 = List.Create(item0=flatten_4, item1=mirror_7)
mirror_8 = Geometry.Mirror(geometry=list_create_9, mirrorPlane=byOriginNormal_4)
list_create_10 = List.Create(item0=mirror_8, item1=list_create_9)
beamByCurve_4 = StructuralFraming.BeamByCurve(curve=list_create_10, level=levels_4, structuralFramingType=horizontal_main_beam)

# group: Beam End Extension
byCoordinates_17 = Point.ByCoordinates(x=x_coord_start_point, z=code_block)
code_block_40 = CodeBlock { -850; }
byCoordinates_18 = Vector.ByCoordinates(x=code_block_40)
add_15 = Point.Add(point=byCoordinates_17, vectorToAdd=byCoordinates_18)
byStartPointEndPoint_7 = Line.ByStartPointEndPoint(startPoint=byCoordinates_17, endPoint=add_15)
mirror_9 = Geometry.Mirror(geometry=byStartPointEndPoint_7, mirrorPlane=byOriginNormal)
list_create_11 = List.Create(item0=mirror_9, item1=byStartPointEndPoint_7)
mirror_10 = Geometry.Mirror(geometry=list_create_11, mirrorPlane=byOriginNormal_4)
list_create_12 = List.Create(item0=mirror_10, item1=list_create_11)
beamByCurve_5 = StructuralFraming.BeamByCurve(curve=list_create_12, level=levels_4, structuralFramingType=horizontal_main_beam)

# group: Diagonals Geometry and Beam Specifications
splitByParameter_4 = Curve.SplitByParameter(curve=byStartPointEndPoint, parameters=sequence_3)
startPoint_4 = Curve.StartPoint(curve=splitByParameter_4)
byStartPointEndPoint_8 = Line.ByStartPointEndPoint(startPoint=startPoint_4, endPoint=startPoint)
endPoint_4 = Curve.EndPoint(curve=splitByParameter_4)
byStartPointEndPoint_9 = Line.ByStartPointEndPoint(startPoint=startPoint, endPoint=endPoint_4)
list_create_13 = List.Create(item0=byStartPointEndPoint_8, item1=byStartPointEndPoint_9)
flatten_5 = List.Flatten(list=list_create_13)
mirror_11 = Geometry.Mirror(geometry=flatten_5, mirrorPlane=byOriginNormal)
list_create_14 = List.Create(item0=mirror_11, item1=flatten_5)
mirror_12 = Geometry.Mirror(geometry=list_create_14, mirrorPlane=byOriginNormal_4)
list_create_15 = List.Create(item0=mirror_12, item1=list_create_14)
levels_5 = Levels("Level 1")
beamByCurve_6 = StructuralFraming.BeamByCurve(curve=list_create_15, level=levels_5, structuralFramingType=diagonal_beam_specification)

# group: Specify y-axis Mirror Plane - 1
code_block_41 = CodeBlock { 0; }
code_block_42 = CodeBlock { 0; }
byCoordinates_19 = Point.ByCoordinates(x=code_block_41, y=midpoint_displacement, z=code_block_42)
YAxis_4 = Vector.YAxis()
byOriginNormal_5 = Plane.ByOriginNormal(origin=byCoordinates_19, normal=YAxis_4)
mirror_13 = Geometry.Mirror(geometry=splitByParameter_4, mirrorPlane=byOriginNormal_5)

# group: Upper Interbeam Connections
startPoint_5 = Curve.StartPoint(curve=mirror_13)
byStartPointEndPoint_10 = Line.ByStartPointEndPoint(startPoint=startPoint_5, endPoint=startPoint_4)
endPoint_5 = Curve.EndPoint(curve=mirror_13)
byStartPointEndPoint_11 = Line.ByStartPointEndPoint(startPoint=endPoint_4, endPoint=endPoint_5)
list_create_16 = List.Create(item0=byStartPointEndPoint_10, item1=byStartPointEndPoint_11)
flatten_6 = List.Flatten(list=list_create_16)
mirror_14 = Geometry.Mirror(geometry=flatten_6, mirrorPlane=byOriginNormal_4)
list_create_17 = List.Create(item0=mirror_14, item1=flatten_6)
levels_6 = Levels("Level 1")
beamByCurve_7 = StructuralFraming.BeamByCurve(curve=list_create_17, level=levels_6, structuralFramingType=upper_interbeam_specification)

# group: Lower Interbeam Connections
code_block_43 = CodeBlock { 0; }
code_block_44 = CodeBlock { 0; }
byCoordinates_20 = Point.ByCoordinates(x=code_block_43, y=midpoint_displacement, z=code_block_44)
YAxis_5 = Vector.YAxis()
byOriginNormal_6 = Plane.ByOriginNormal(origin=byCoordinates_20, normal=YAxis_5)
mirror_15 = Geometry.Mirror(geometry=takeEveryNthItem, mirrorPlane=byOriginNormal_6)
startPoint_6 = Curve.StartPoint(curve=mirror_15)
byStartPointEndPoint_12 = Line.ByStartPointEndPoint(startPoint=startPoint, endPoint=startPoint_6)
mirror_16 = Geometry.Mirror(geometry=byStartPointEndPoint_12, mirrorPlane=byOriginNormal_4)
list_create_18 = List.Create(item0=mirror_16, item1=byStartPointEndPoint_12)
levels_7 = Levels("Level 1")
beamByCurve_8 = StructuralFraming.BeamByCurve(curve=list_create_18, level=levels_7, structuralFramingType=lower_interbeam_specification)

# group: Diagonals Geometry and Beam Specifications
splitByParameter_5 = Curve.SplitByParameter(curve=byStartPointEndPoint_2, parameters=sequence)
startPoint_7 = Curve.StartPoint(curve=splitByParameter_5)
byStartPointEndPoint_13 = Line.ByStartPointEndPoint(startPoint=startPoint_7, endPoint=startPoint_2)
endPoint_6 = Curve.EndPoint(curve=splitByParameter_5)
byStartPointEndPoint_14 = Line.ByStartPointEndPoint(startPoint=startPoint_2, endPoint=endPoint_6)
list_create_19 = List.Create(item0=byStartPointEndPoint_13, item1=byStartPointEndPoint_14)
flatten_7 = List.Flatten(list=list_create_19)
mirror_17 = Geometry.Mirror(geometry=flatten_7, mirrorPlane=byOriginNormal_2)
list_create_20 = List.Create(item0=mirror_17, item1=flatten_7)
mirror_18 = Geometry.Mirror(geometry=list_create_20, mirrorPlane=byOriginNormal_4)
list_create_21 = List.Create(item0=mirror_18, item1=list_create_20)
levels_8 = Levels("Level 1")
beamByCurve_9 = StructuralFraming.BeamByCurve(curve=list_create_21, level=levels_8, structuralFramingType=diagonal_beam_specification_2)

# group: Horizontal Main Beam Specifications
list_create_22 = List.Create(item0=translate_4, item1=byStartPointEndPoint_2)
flatten_8 = List.Flatten(list=list_create_22)
mirror_19 = Geometry.Mirror(geometry=flatten_8, mirrorPlane=byOriginNormal_2)
list_create_23 = List.Create(item0=flatten_8, item1=mirror_19)
mirror_20 = Geometry.Mirror(geometry=list_create_23, mirrorPlane=byOriginNormal_4)
list_create_24 = List.Create(item0=mirror_20, item1=list_create_23)
flatten_9 = List.Flatten(list=list_create_24)
levels_9 = Levels("Level 1")
beamByCurve_10 = StructuralFraming.BeamByCurve(curve=flatten_9, level=levels_9, structuralFramingType=horizontal_main_beam_2)

# group: Specify y-axis Mirror Plane - 1
code_block_45 = CodeBlock { 0; }
code_block_46 = CodeBlock { 0; }
byCoordinates_21 = Point.ByCoordinates(x=code_block_45, y=midpoint_displacement_2, z=code_block_46)
YAxis_6 = Vector.YAxis()
byOriginNormal_7 = Plane.ByOriginNormal(origin=byCoordinates_21, normal=YAxis_6)
mirror_21 = Geometry.Mirror(geometry=splitByParameter_5, mirrorPlane=byOriginNormal_7)

# group: Upper Interbeam Connections
startPoint_8 = Curve.StartPoint(curve=mirror_21)
byStartPointEndPoint_15 = Line.ByStartPointEndPoint(startPoint=startPoint_8, endPoint=startPoint_7)
endPoint_7 = Curve.EndPoint(curve=mirror_21)
byStartPointEndPoint_16 = Line.ByStartPointEndPoint(startPoint=endPoint_6, endPoint=endPoint_7)
list_create_25 = List.Create(item0=byStartPointEndPoint_15, item1=byStartPointEndPoint_16)
flatten_10 = List.Flatten(list=list_create_25)
mirror_22 = Geometry.Mirror(geometry=flatten_10, mirrorPlane=byOriginNormal_4)
list_create_26 = List.Create(item0=mirror_22, item1=flatten_10)
levels_10 = Levels("Level 1")
beamByCurve_11 = StructuralFraming.BeamByCurve(curve=list_create_26, level=levels_10, structuralFramingType=upper_interbeam_specification_2)

# group: Lower Interbeam Connections
code_block_47 = CodeBlock { 0; }
code_block_48 = CodeBlock { 0; }
byCoordinates_22 = Point.ByCoordinates(x=code_block_47, y=midpoint_displacement_2, z=code_block_48)
YAxis_7 = Vector.YAxis()
byOriginNormal_8 = Plane.ByOriginNormal(origin=byCoordinates_22, normal=YAxis_7)
mirror_23 = Geometry.Mirror(geometry=takeEveryNthItem_2, mirrorPlane=byOriginNormal_8)
startPoint_9 = Curve.StartPoint(curve=mirror_23)
byStartPointEndPoint_17 = Line.ByStartPointEndPoint(startPoint=startPoint_2, endPoint=startPoint_9)
mirror_24 = Geometry.Mirror(geometry=byStartPointEndPoint_17, mirrorPlane=byOriginNormal_4)
list_create_27 = List.Create(item0=mirror_24, item1=byStartPointEndPoint_17)
levels_11 = Levels("Level 1")
beamByCurve_12 = StructuralFraming.BeamByCurve(curve=list_create_27, level=levels_11, structuralFramingType=lower_interbeam_specification_2)

# group: Diagonals Geometry and Beam Specifications
splitByParameter_6 = Curve.SplitByParameter(curve=byStartPointEndPoint_3, parameters=sequence_2)
startPoint_10 = Curve.StartPoint(curve=splitByParameter_6)
byStartPointEndPoint_18 = Line.ByStartPointEndPoint(startPoint=startPoint_10, endPoint=startPoint_3)
endPoint_8 = Curve.EndPoint(curve=splitByParameter_6)
byStartPointEndPoint_19 = Line.ByStartPointEndPoint(startPoint=startPoint_3, endPoint=endPoint_8)
list_create_28 = List.Create(item0=byStartPointEndPoint_18, item1=byStartPointEndPoint_19)
flatten_11 = List.Flatten(list=list_create_28)
mirror_25 = Geometry.Mirror(geometry=flatten_11, mirrorPlane=byOriginNormal_3)
list_create_29 = List.Create(item0=mirror_25, item1=flatten_11)
levels_12 = Levels("Level 1")
beamByCurve_13 = StructuralFraming.BeamByCurve(curve=list_create_29, level=levels_12, structuralFramingType=diagonal_beam_specification_3)

# group: Horizontal Main Beam Specifications
list_create_30 = List.Create(item0=translate_6, item1=byStartPointEndPoint_3)
flatten_12 = List.Flatten(list=list_create_30)
mirror_26 = Geometry.Mirror(geometry=flatten_12, mirrorPlane=byOriginNormal_3)
list_create_31 = List.Create(item0=flatten_12, item1=mirror_26)
levels_13 = Levels("Level 1")
beamByCurve_14 = StructuralFraming.BeamByCurve(curve=list_create_31, level=levels_13, structuralFramingType=horizontal_main_beam_3)

# group: Specify y-axis Mirror Plane - 1
code_block_49 = CodeBlock { 0; }
code_block_50 = CodeBlock { 0; }
byCoordinates_23 = Point.ByCoordinates(x=code_block_49, y=midpoint_displacement_3, z=code_block_50)
YAxis_8 = Vector.YAxis()
byOriginNormal_9 = Plane.ByOriginNormal(origin=byCoordinates_23, normal=YAxis_8)
mirror_27 = Geometry.Mirror(geometry=splitByParameter_6, mirrorPlane=byOriginNormal_9)

# group: Upper Interbeam Connections
startPoint_11 = Curve.StartPoint(curve=mirror_27)
byStartPointEndPoint_20 = Line.ByStartPointEndPoint(startPoint=startPoint_11, endPoint=startPoint_10)
endPoint_9 = Curve.EndPoint(curve=mirror_27)
byStartPointEndPoint_21 = Line.ByStartPointEndPoint(startPoint=endPoint_8, endPoint=endPoint_9)
list_create_32 = List.Create(item0=byStartPointEndPoint_20, item1=byStartPointEndPoint_21)
flatten_13 = List.Flatten(list=list_create_32)
levels_14 = Levels("Level 1")
beamByCurve_15 = StructuralFraming.BeamByCurve(curve=flatten_13, level=levels_14, structuralFramingType=upper_interbeam_specification_3)

# group: Lower Interbeam Connections
code_block_51 = CodeBlock { 0; }
code_block_52 = CodeBlock { 0; }
byCoordinates_24 = Point.ByCoordinates(x=code_block_51, y=midpoint_displacement_3, z=code_block_52)
YAxis_9 = Vector.YAxis()
byOriginNormal_10 = Plane.ByOriginNormal(origin=byCoordinates_24, normal=YAxis_9)
mirror_28 = Geometry.Mirror(geometry=takeEveryNthItem_3, mirrorPlane=byOriginNormal_10)
startPoint_12 = Curve.StartPoint(curve=mirror_28)
byStartPointEndPoint_22 = Line.ByStartPointEndPoint(startPoint=startPoint_3, endPoint=startPoint_12)
levels_15 = Levels("Level 1")
beamByCurve_16 = StructuralFraming.BeamByCurve(curve=byStartPointEndPoint_22, level=levels_15, structuralFramingType=lower_interbeam_specification_3)

# group: Material Property List
flatten_14 = List.Flatten(list=list_create_7)
list_create_33 = List.Create(item0=beamByCurve_5, item1=beamByCurve_6, item2=beamByCurve_4, item3=beamByCurve_7, item4=beamByCurve_8)
list_create_34 = List.Create(item0=beamByCurve_9, item1=beamByCurve_10, item2=beamByCurve_11, item3=beamByCurve_12)
list_create_35 = List.Create(item0=beamByCurve_13, item1=beamByCurve_14, item2=beamByCurve_15, item3=beamByCurve_16)
list_create_36 = List.Create(item0=flatten_14, item1=list_create_33, item2=list_create_34, item3=list_create_35)
flatten_15 = List.Flatten(list=list_create_36)
location = StructuralFraming.Location(structuralFraming=flatten_15)

# group: Family Type Extraction
code_block_53 = CodeBlock { "Family"; }
parameterByName = Parameter.ParameterByName(element=flatten_15, name=code_block_53)
string_from_object = FromObject(obj=parameterByName)
code_block_54 = CodeBlock { "Family : "; }
split = String.Split(str=string_from_object, separator0=code_block_54)
code_block_55 = CodeBlock { "Type"; }
parameterByName_2 = Parameter.ParameterByName(element=flatten_15, name=code_block_55)
string_from_object_2 = FromObject(obj=parameterByName_2)
code_block_56 = CodeBlock { "Type : "; }
split_2 = String.Split(str=string_from_object_2, separator0=code_block_56)
byFamilyNameAndTypeName = FamilyType.ByFamilyNameAndTypeName(familyName=split, typeName=split_2)

# group: Second Beam Geometry and settings
code_block_57 = CodeBlock { 9000; }
byCoordinates_25 = Vector.ByCoordinates(y=code_block_57)
translate_7 = Geometry.Translate(geometry=location, direction=byCoordinates_25)
levels_16 = Levels("Level 2")
beamByCurve_17 = StructuralFraming.BeamByCurve(curve=translate_7, level=levels_16, structuralFramingType=byFamilyNameAndTypeName)

# group: Additional Beam List Modifications
list_create_37 = List.Create(item0=flatten_15, item1=beamByCurve_17)
flatten_16 = List.Flatten(list=list_create_37)
location_2 = StructuralFraming.Location(structuralFraming=flatten_16)

# group: Export Tools, start coords, end coords, beam length
string = StringInput("C:\Users\brendanlia\Desktop\TrussGeometryExport.xlsx")
code_block_58 = CodeBlock { "Sheet 1"; }
code_block_59 = CodeBlock { 0; }
code_block_60 = CodeBlock { "X Start"; "Y Start"; "Z Start"; "X End"; "Y End"; "Z End"; "Length (mm)"; "Structure Type"; }
list_create_38 = List.Create(item0=code_block_60.out0, item1=code_block_60.out1, item2=code_block_60.out2, item3=code_block_60.out3, item4=code_block_60.out4, item5=code_block_60.out5, item6=code_block_60.out6, item7=code_block_60.out7)
string_from_object_3 = FromObject(obj=location_2)
code_block_61 = CodeBlock { ","; "="; "("; ")"; }
split_3 = String.Split(str=string_from_object_3, separator0=code_block_61.out0, separator1=code_block_61.out1, separator2=code_block_61.out2, separator3=code_block_61.out3)
code_block_62 = CodeBlock { 4; 6; 8; 12; 14; 16; 26; }
list_create_39 = List.Create(item0=code_block_62.out0, item1=code_block_62.out1, item2=code_block_62.out2, item3=code_block_62.out3, item4=code_block_62.out4, item5=code_block_62.out5, item6=code_block_62.out6)
getItemAtIndex = List.GetItemAtIndex(list=split_3@L2, index=list_create_39)
string_2 = StringInput("C:\Users\brendanlia\Desktop\export.csv")

# group: Append Structure Type
string_from_object_4 = FromObject(obj=flatten_16)
code_block_63 = CodeBlock { ","; "="; }
split_4 = String.Split(str=string_from_object_4, separator0=code_block_63.out0, separator1=code_block_63.out1)
code_block_64 = CodeBlock { 1; }
getItemAtIndex_2 = List.GetItemAtIndex(list=split_4@L2, index=code_block_64)
addItemToEnd = List.AddItemToEnd(item=getItemAtIndex_2@L1, list=getItemAtIndex@L2)

# group (continued): Export Tools, start coords, end coords, beam length
addItemToFront = List.AddItemToFront(item=list_create_38, list=addItemToEnd)
exportExcel = Data.ExportExcel(filePath=string, sheetName=code_block_58, startRow=code_block_59, startCol=code_block_59, data=addItemToFront)
exportCSV = Data.ExportCSV(filePath=string_2, data=addItemToFront)
