# Dynamo graph Standard Module A.dyn (Dynamo 2.1.0.7500)

code_block = CodeBlock { 3000; }
byCoordinates = Point.ByCoordinates(z=code_block)
number_slider = DoubleSlider(10500, range=0..20000 step 1)
byCoordinates_2 = Vector.ByCoordinates(x=number_slider)
add = Point.Add(point=byCoordinates, vectorToAdd=byCoordinates_2)
byStartPointEndPoint = Line.ByStartPointEndPoint(startPoint=byCoordinates, endPoint=add)
code_block_2 = CodeBlock { 1; }
integer_slider = IntegerSlider(3, range=0..10 step 1)
div = code_block_2 / integer_slider
code_block_3 = CodeBlock(x=integer_slider) { x-1; }
sequence = Sequence(start=div, amount=code_block_3, step=div)
splitByParameter = Curve.SplitByParameter(curve=byStartPointEndPoint, parameters=sequence)
startPoint = Curve.StartPoint(curve=splitByParameter)
code_block_4 = CodeBlock { 1; }
code_block_5 = CodeBlock(x=integer_slider) { 2*x; }
div_2 = code_block_4 / code_block_5
code_block_6 = CodeBlock(x=integer_slider) { 2*x-1; }
sequence_2 = Sequence(start=div_2, amount=code_block_6, step=div_2)
splitByParameter_2 = Curve.SplitByParameter(curve=byStartPointEndPoint, parameters=sequence_2)
number_slider_2 = DoubleSlider(-3000, range=-3000..3000 step 0.1)
translate = Geometry.Translate(geometry=splitByParameter_2, zTranslation=number_slider_2)
code_block_7 = CodeBlock { 2; }
code_block_8 = CodeBlock { 0; }
takeEveryNthItem = List.TakeEveryNthItem(list=translate, n=code_block_7, offset=code_block_8)
startPoint_2 = Curve.StartPoint(curve=takeEveryNthItem)
byStartPointEndPoint_2 = Line.ByStartPointEndPoint(startPoint=startPoint, endPoint=startPoint_2)
endPoint = Curve.EndPoint(curve=splitByParameter)
byStartPointEndPoint_3 = Line.ByStartPointEndPoint(startPoint=startPoint_2, endPoint=endPoint)
list_create = List.Create(item0=byStartPointEndPoint_2, item1=byStartPointEndPoint_3)
flatten = List.Flatten(list=list_create)
levels = Levels("Level 1")
structural_framing_types = StructuralFramingTypes("203x102x23UB")
beamByCurve = StructuralFraming.BeamByCurve(curve=flatten, level=levels, structuralFramingType=structural_framing_types)
translate_2 = Geometry.Translate(geometry=byStartPointEndPoint, zTranslation=number_slider_2)
list_create_2 = List.Create(item0=translate_2, item1=byStartPointEndPoint)
flatten_2 = List.Flatten(list=list_create_2)
levels_2 = Levels("Level 1")
structural_framing_types_2 = StructuralFramingTypes("305x165x40UB")
beamByCurve_2 = StructuralFraming.BeamByCurve(curve=flatten_2, level=levels_2, structuralFramingType=structural_framing_types_2)
code_block_9 = CodeBlock { 0; }
midpoint_displacement = DoubleSlider(750, range=0..750 step 0.1)
code_block_10 = CodeBlock { 0; }
byCoordinates_3 = Point.ByCoordinates(x=code_block_9, y=midpoint_displacement, z=code_block_10)
YAxis = Vector.YAxis()
byOriginNormal = Plane.ByOriginNormal(origin=byCoordinates_3, normal=YAxis)
mirror = Geometry.Mirror(geometry=flatten, mirrorPlane=byOriginNormal)
beamByCurve_3 = StructuralFraming.BeamByCurve(curve=mirror, level=levels, structuralFramingType=structural_framing_types)
mirror_2 = Geometry.Mirror(geometry=flatten_2, mirrorPlane=byOriginNormal)
beamByCurve_4 = StructuralFraming.BeamByCurve(curve=mirror_2, level=levels_2, structuralFramingType=structural_framing_types_2)
code_block_11 = CodeBlock { 0; }
code_block_12 = CodeBlock { 0; }
byCoordinates_4 = Point.ByCoordinates(x=code_block_11, y=midpoint_displacement, z=code_block_12)
YAxis_2 = Vector.YAxis()
byOriginNormal_2 = Plane.ByOriginNormal(origin=byCoordinates_4, normal=YAxis_2)
mirror_3 = Geometry.Mirror(geometry=splitByParameter, mirrorPlane=byOriginNormal_2)
startPoint_3 = Curve.StartPoint(curve=mirror_3)
byStartPointEndPoint_4 = Line.ByStartPointEndPoint(startPoint=startPoint_3, endPoint=startPoint)
endPoint_2 = Curve.EndPoint(curve=mirror_3)
byStartPointEndPoint_5 = Line.ByStartPointEndPoint(startPoint=endPoint, endPoint=endPoint_2)
list_create_3 = List.Create(item0=byStartPointEndPoint_4, item1=byStartPointEndPoint_5)
flatten_3 = List.Flatten(list=list_create_3)
levels_3 = Levels("Level 1")
structural_framing_types_3 = StructuralFramingTypes("305x165x40UB")
beamByCurve_5 = StructuralFraming.BeamByCurve(curve=flatten_3, level=levels_3, structuralFramingType=structural_framing_types_3)
code_block_13 = CodeBlock { 0; }
code_block_14 = CodeBlock { 0; }
byCoordinates_5 = Point.ByCoordinates(x=code_block_13, y=midpoint_displacement, z=code_block_14)
YAxis_3 = Vector.YAxis()
byOriginNormal_3 = Plane.ByOriginNormal(origin=byCoordinates_5, normal=YAxis_3)
mirror_4 = Geometry.Mirror(geometry=takeEveryNthItem, mirrorPlane=byOriginNormal_3)
endPoint_3 = Curve.EndPoint(curve=mirror_4)
startPoint_4 = Curve.StartPoint(curve=mirror_4)
byStartPointEndPoint_6 = Line.ByStartPointEndPoint(startPoint=startPoint_2, endPoint=startPoint_4)
levels_4 = Levels("Level 1")
structural_framing_types_4 = StructuralFramingTypes("254x146x31UB")
beamByCurve_6 = StructuralFraming.BeamByCurve(curve=byStartPointEndPoint_6, level=levels_4, structuralFramingType=structural_framing_types_4)
endPoint_4 = Curve.EndPoint(curve=takeEveryNthItem)
