# Grasshopper definition Visualisation.gh (Grasshopper 1.0.7)
# plug-ins: EleFront, TT Toolbox

displacement_sheet = Panel("C:\Users\brendanlia\Desktop\Joint Data\Joint_Displacement.xlsx")
coordinate_sheet = Panel("C:\Users\brendanlia\Desktop\Joint Data\Joint_Coordinates.xlsx")

export_property_1_u1_2_u2_3_u3_4_r1_5_r2 = Panel("3")  # "Export Property, (1 = U1, 2 = U2, 3 = U3, 4 = R1, 5 = R2, 6 = R3)"
stage_number = Panel("150")
node_numbers = Panel("""148
273
450
602
1731
3586
4375
5150
7271
8564
TG50
11711
14296
17549
26221
TG504
N26335""")

read_excel_sheet = ReadExcelSheet(Run=Toggle(True), FilePath=coordinate_sheet, Worksheet="1", Listen=False)  # -> UserMessages, Columns, Rows
shift_list = ShiftList(List=read_excel_sheet.Columns, Shift="3", Wrap=True)  # -> simplify(List)

read_excel_sheet_2 = ReadExcelSheet(Run=Toggle(True), FilePath=displacement_sheet, Worksheet="1", Listen=False)  # -> UserMessages, Columns, Rows
shift_list_2 = ShiftList(List=read_excel_sheet_2.Columns, Shift="3", Wrap=True)  # -> simplify(List)

tree_branch = TreeBranch(Tree=shift_list, Path="{1}", MaintainPaths=True)
member_index = MemberIndex(Set=tree_branch, Member=node_numbers)  # -> Index, Count
panel = Panel(member_index.Index)

addition = Addition(A=export_property_1_u1_2_u2_3_u3_4_r1_5_r2, B="6")
tree_branch_2 = TreeBranch(Tree=shift_list_2, Path=addition, MaintainPaths=True)

tree_branch_3 = TreeBranch(Tree=shift_list, Path="8", MaintainPaths=True)
tree_branch_4 = TreeBranch(Tree=shift_list, Path="10", MaintainPaths=True)
tree_branch_5 = TreeBranch(Tree=shift_list, Path="9", MaintainPaths=True)

tree_branch_6 = TreeBranch(Tree=shift_list_2, Path="{1}", MaintainPaths=True)
tree_branch_7 = TreeBranch(Tree=shift_list_2, Path="{5}", MaintainPaths=True)
member_index_2 = MemberIndex(Set=tree_branch_7, Member=stage_number)  # -> Index, Count
member_index_3 = MemberIndex(Set=tree_branch_6, Member=node_numbers)  # -> Index, Count
set_intersection = SetIntersection(SetA=member_index_3.Index, SetB=member_index_2.Index)

tree_item_index = TreeItemIndex(DataTree=tree_branch_3, BranchIndex=0, ItemIndex=panel)
tree_item_index_2 = TreeItemIndex(DataTree=tree_branch_4, BranchIndex=0, ItemIndex=panel)
tree_item_index_3 = TreeItemIndex(DataTree=tree_branch_5, BranchIndex=0, ItemIndex=panel)
flatten_tree = FlattenTree(Tree=tree_item_index_2, Path="{0}")
flatten_tree_2 = FlattenTree(Tree=tree_item_index, Path="{0}")
flatten_tree_3 = FlattenTree(Tree=tree_item_index_3, Path="{0}")
construct_point = ConstructPoint(XCoordinate=flatten_tree_2, YCoordinate=flatten_tree_3, ZCoordinate=flatten_tree)

boolean_toggle = BooleanToggle(True)
panel_2 = Panel(construct_point)

tree_item_index_4 = TreeItemIndex(DataTree=tree_branch_2, BranchIndex=0, ItemIndex=set_intersection)
addition_2 = Addition(A=flatten_tree_2, B="1500")
flatten_tree_4 = FlattenTree(Tree=tree_item_index_4, Path="{0}")
round = Round(Number=flatten_tree_4)  # -> Nearest, Floor, Ceiling

addition_3 = Addition(A=flatten_tree_3, B="1500")

construct_point_2 = ConstructPoint(XCoordinate=addition_2, YCoordinate=addition_3, ZCoordinate=flatten_tree)
define_text_dot = DefineTextDot(Text=round.Nearest, Location=construct_point_2, Font="Arial", Size=14)

panel_3 = Panel(tree_item_index_4)

bake_objects = BakeObjects(Geometry=construct_point, BakeName="Points", Bake=False)
bake_objects_2 = BakeObjects(Geometry=define_text_dot, BakeName="Text", Bake=False)
